# Grasshopper definition Hall System_Optimization Model_ESG_VUG_2024.gh (Grasshopper 1.0.7)
# plug-ins: Octopus, CORE.Toolbox.Grasshopper

# ----
# Calculation parameters
list = ValueList({"vb[m/s]: 21": 21, "vb[m/s]: 22": 22, "vb[m/s]: 23": 23, "vb[m/s]: 24": 24, "vb[m/s]: 25": 25, "vb[m/s]: 26": 26}, selected="vb[m/s]: 24")
list_2 = ValueList({"Terrain category 0": 0, "Terrain category I": 1, "Terrain category II": 2, "Terrain category III": 3, "Terrain category IV": 4}, selected="Terrain category III")
list_3 = ValueList({"SZ 1": 1, "SZ 1.5": 1.5, "SZ 2.0": 2.0, "SZ 2.5": 2.5, "SZ 3.0": 3.0, "SZ 3.5": 3.5, "SZ 4.0": 4.0, "SZ 4.5": 4.5, "SZ 5.5": 5.5}, selected="SZ 2.0")
exposure_coefficient_snowload = ValueList({"exposure normal": 1.0, "wind exposed": 0.8, "not wind exposed": 1.2}, selected="exposure normal")
list_4 = ValueList({"GL22h": "22,17.6,0.5,22,2.5,3.5,1.2,8800,250,540,10500,300,650,370,410", "GL24h": "24,19.2,0.5,24,2.5,3.5,1.2,9600,250,540,11500,300,650,385,420", "GL26h": "26,20.8,0.5,26,2.5,3.5,1.2,10100,250,540,12100,300,650,405,445", "GL28h": "28,22.4,0.5,28,2.5,3.5,1.2,10500,250,540,12600,300,650,425,460", "GL28hs": "28,22.4,0.5,28,2.5,3.5,1.2,10500,250,540,13100,300,650,430,480", "GL30h": "30,24,0.5,30,2.5,3.5,1.2,11300,250,540,13600,300,650,430,480", "GL32h": "32,25.6,0.5,32,2.5,3.5,1.2,11800,250,540,14200,300,650,440,490", "GL22c": "22,16,0.5,20,2.5,3.5,1.2,8600,250,540,10400,300,650,355,390", "GL24c": "24,17,0.5,21.5,2.5,3.5,1.2,9100,250,540,11000,300,650,365,400", "GL26c": "26,19,0.5,23.5,2.5,3.5,1.2,10000,250,540,12000,300,650,385,420", "GL28c": "28,19.5,0.5,24,2.5,3.5,1.2,10400,250,540,12500,300,650,390,420", "GL28cs": "28,19.5,0.5,24,2.5,3.5,1.2,10400,250,540,12500,300,650,390,430", "GL30c": "30,19.5,0.5,24.5,2.5,3.5,1.2,10800,250,540,13000,300,650,390,430", "GL32c": "32,19.5,0.5,24.5,2.5,3.5,1.2,11200,250,540,13500,300,650,400,440"}, selected="GL32h")
list_5 = ValueList({"R30": 30, "R60": 60, "R90": 90, "R120": 120, "R180": 180}, selected="R60")
load_duration_class = ValueList({"P": "0.6,0.6,0.5", "L": "0.7,0.7,0.55", "M": "0.8,0.8,0.65", "S": "0.9,0.9,0.7", "I": "1.1,1.1,0.9"}, selected="M")
list_6 = ValueList({"Safety class 1": 0.83, "Safety class 2": 0.91, "Safety class 3": 1.00}, selected="Safety class 3")
list_7 = ValueList({"Service class 1": 0, "Service class 2": 1, "Service class 3": 2}, selected="Service class 1")
dead_load_kn_m_2 = Slider(1.5, range=0..10)
live_load_kn_m_2 = Slider(1, range=0..10)

# ---- group: section inputs
v0 = Panel("0.01")
kdis = Panel("1.4")

v0_2 = Panel("0.01")
kdis_2 = Panel("1.4")

# ----
# Optimization
octopus = Octopus(
    OctopusData_gene=[ec_m_horizontal, hb_mm, angle_apex_degree, bb_mm, column_cs_ratio_rc, nf_ratio],
    OctopusData_obj=[volume, bool])

# ----
# Data Writing with TTToolbox
# *note: if too much data is being written the panel overloads and other writing tools must be used
panel = Panel("*Add a path file here")
path = FilePath(panel)
parameter_names = Panel("""S
H
L
hB
bB
Alpha
rC
nF
actual ec
MB
bC
hC
cc
nP
bP
hP
bCS
hCS
dr
dw
Volume
V/m^2""")

# ----
# Geometrical parameters
frame_span_s_jon_m = Slider(20, range=20..40)
column_cs_ratio_rc = Slider(1.1, range=1..2)
height_h_m = Slider(7, range=5..15)
angle_apex_degree = Slider(3, range=3..10)
bb_mm = Slider(7, range=3..11, expression="x*45")
column_width_bc_bb_mm = Panel(bb_mm)
multiplication = Multiplication(A=bb_mm, B=column_cs_ratio_rc)
hb_mm = Slider(44, range=5..45, expression="x*45")
hc_bc_x_mm = Panel(multiplication)

# ----
# Wind Calculations
# Side wind load
division = Division(A=hb_mm, _1000=1000)
C = Panel("""-0.5
-0.5
-0.5""")
A = Panel("""-1.2
-1.2
-1.2""")
B = Panel("""-0.8
-0.8
-0.8""")
D = Panel("""0.8
0.8
0.7""")
E = Panel("""-0.7
-0.5
-0.3""")
d1_s = Panel(frame_span_s_jon_m)
addition = Addition(A=height_h_m, B=division)
python = GhPythonScript(TC=list_2, H=addition, vb=list)  # -> flatten(out), a
# ---------- python: Python ----------
__author__ = "ext-elisabet.gunnars"
__version__ = "2024.02.28"

import rhinoscriptsyntax as rs
import math


if vb ==21:
    if H < 8 or H==8:
        if TC == 0:
            print 0.74
        if TC == 1:
            print 0.67
        if TC == 2:
            print 0.56
        if TC == 3:
            print 0.39
        if TC == 4:
            print 0.29
    if  8 < H < 12 or H==12:
        if TC == 0:
            print 0.8
        if TC == 1:
            print 0.74
        if TC == 2:
            print 0.63
        if TC == 3:
            print 0.46
        if TC == 4:
            print 0.32
    if  12 < H < 16:
        if TC == 0:
            print 0.84
        if TC == 1:
            print 0.78
        if TC == 2:
            print 0.68
        if TC == 3:
            print 0.51
        if TC == 4:
            print 0.37


if vb ==22:
    if H < 8 or H==8:
        if TC == 0:
            print 0.81
        if TC == 1:
            print 0.74
        if TC == 2:
            print 0.61
        if TC == 3:
            print 0.43
        if TC == 4:
            print 0.32
    if  8 < H < 12 or H==12:
        if TC == 0:
            print 0.87
        if TC == 1:
            print 0.81
        if TC == 2:
            print 0.69
        if TC == 3:
            print 0.50
        if TC == 4:
            print 0.35
    if  12 < H < 16:
        if TC == 0:
            print 0.92
        if TC == 1:
            print 0.86
        if TC == 2:
            print 0.74
        if TC == 3:
            print 0.56
        if TC == 4:
            print 0.40


if vb ==23:
    if H < 8 or H==8:
        if TC == 0:
            print 0.88
        if TC == 1:
            print 0.81
        if TC == 2:
            print 0.67
        if TC == 3:
            print 0.47
        if TC == 4:
            print 0.35
    if  8 < H < 12 or H==12:
        if TC == 0:
            print 0.95
        if TC == 1:
            print 0.88
        if TC == 2:
            print 0.75
        if TC == 3:
            print 0.55
        if TC == 4:
            print 0.38
    if  12 < H < 16:
        if TC == 0:
            print 1.01
        if TC == 1:
            print 0.94
        if TC == 2:
            print 0.81
        if TC == 3:
            print 0.61
        if TC == 4:
            print 0.44

if vb ==24:
    if H < 8 or H==8:
        if TC == 0:
            print 0.96
        if TC == 1:
            print 0.88
        if TC == 2:
            print 0.73
        if TC == 3:
            print 0.51
        if TC == 4:
            print 0.38
    if  8 < H < 12 or H==12:
        if TC == 0:
            print 1.04
        if TC == 1:
            print 0.96
        if TC == 2:
            print 0.82
        if TC == 3:
            print 0.60
        if TC == 4:
            print 0.42
    if  12 < H < 16:
        if TC == 0:
            print 1.10
        if TC == 1:
            print 1.02
        if TC == 2:
            print 0.88
        if TC == 3:
            print 0.66
        if TC == 4:
            print 0.48

if vb ==25:
    if H < 8 or H==8:
        if TC == 0:
            print 1.04
        if TC == 1:
            print 0.95
        if TC == 2:
            print 0.79
        if TC == 3:
            print 0.55
        if TC == 4:
            print 0.41
    if  8 < H < 12 or H==12:
        if TC == 0:
            print 1.13
        if TC == 1:
            print 1.04
        if TC == 2:
            print 0.89
        if TC == 3:
            print 0.65
        if TC == 4:
            print 0.45
    if  12 < H < 16:
        if TC == 0:
            print 1.19
        if TC == 1:
            print 1.10
        if TC == 2:
            print 0.96
        if TC == 3:
            print 0.72
        if TC == 4:
            print 0.52

if vb ==26:
    if H < 8 or H==8:
        if TC == 0:
            print 1.13
        if TC == 1:
            print 1.03
        if TC == 2:
            print 0.86
        if TC == 3:
            print 0.60
        if TC == 4:
            print 0.44
    if  8 < H < 12 or H==12:
        if TC == 0:
            print 1.22
        if TC == 1:
            print 1.13
        if TC == 2:
            print 0.96
        if TC == 3:
            print 0.70
        if TC == 4:
            print 0.49
    if  12 < H < 16:
        if TC == 0:
            print 1.29
        if TC == 1:
            print 1.20
        if TC == 2:
            print 1.04
        if TC == 3:
            print 0.78
        if TC == 4:
            print 0.56
# ---------- end python ----------
division_2 = Division(A=addition, D1=d1_s)
qp_z = Panel(python.out)
python_2 = GhPythonScript(x=division_2)  # -> out, a
# ---------- python_2: Python ----------
__author__ = "ext-elisabet.gunnars"
__version__ = "2024.02.28"

import rhinoscriptsyntax as rs

if x < 0.25:
    print 2
if 0.25 < x < 1:
    print 1
if 1 < x < 5:
    print 0
# ---------- end python_2 ----------
item = ListItem(List=C, Index=python_2.out, Wrap=True)
item_2 = ListItem(List=B, Index=python_2.out, Wrap=True)
item_3 = ListItem(List=A, Index=python_2.out, Wrap=True)
item_4 = ListItem(List=D, Index=python_2.out, Wrap=True)
item_5 = ListItem(List=E, Index=python_2.out, Wrap=True)
multiplication_2 = Multiplication(A=item_2, B=python.out)  # -> flatten(Result)
multiplication_3 = Multiplication(A=item_3, B=python.out)  # -> flatten(Result)
multiplication_4 = Multiplication(A=item, B=python.out)  # -> flatten(Result)
multiplication_5 = Multiplication(A=item_4, B=python.out)  # -> flatten(Result)
panel_2 = Panel(division_2)
multiplication_6 = Multiplication(A=item_5, B=python.out)  # -> flatten(Result)
panel_3 = Panel(multiplication_3)
panel_4 = Panel(multiplication_2)
panel_5 = Panel(multiplication_6)
panel_6 = Panel(multiplication_4)
panel_7 = Panel(multiplication_5)

# ---- group: Line Model
pt = ConstructPoint(XCoordinate="0", YCoordinate="0", ZCoordinate="0")
pt_2 = ConstructPoint(XCoordinate=frame_span_s_jon_m, YCoordinate="0", ZCoordinate=height_h_m)
pt_3 = ConstructPoint(XCoordinate="0", YCoordinate="0", ZCoordinate=height_h_m)
pt_4 = ConstructPoint(XCoordinate=frame_span_s_jon_m, YCoordinate="0", ZCoordinate="0")
column_b = Line(StartPoint=pt_2, EndPoint=pt_4)
column_a = Line(StartPoint=pt_3, EndPoint=pt)
beam = Line(StartPoint=pt_3, EndPoint=pt_2)

# ----
# Geometrical parameters (Frame)
ec_m_horizontal = Slider(25, range=10..25, expression="x*0.2")
nf_ratio = Slider(0.07, range=0..1)
hall_lenght_l_m = Slider(40, range=40..80)

# ----
# Front wind load
E_2 = Panel("""-0.7
-0.5
-0.3""")
A_2 = Panel("""-1.2
-1.2
-1.2""")
C_2 = Panel("""-0.5
-0.5
-0.5""")
B_2 = Panel("""-0.8
-0.8
-0.8""")
D_2 = Panel("""0.8
0.8
0.7""")
python_3 = GhPythonScript(TC=list_2, H=addition, vb=list)  # -> flatten(out), a; same code as python
d2_l = Panel(hall_lenght_l_m)
division_3 = Division(A=addition, D1=d2_l)
qp_z_2 = Panel(python_3.out)
python_4 = GhPythonScript(x=division_3)  # -> out, a; same code as python_2
item_6 = ListItem(List=D_2, Index=python_4.out, Wrap=True)
item_7 = ListItem(List=B_2, Index=python_4.out, Wrap=True)
item_8 = ListItem(List=C_2, Index=python_4.out, Wrap=True)
item_9 = ListItem(List=E_2, Index=python_4.out, Wrap=True)
item_10 = ListItem(List=A_2, Index=python_4.out, Wrap=True)
multiplication_7 = Multiplication(A=item_8, B=python_3.out)  # -> flatten(Result)
multiplication_8 = Multiplication(A=item_10, B=python_3.out)  # -> flatten(Result)
multiplication_9 = Multiplication(A=item_7, B=python_3.out)  # -> flatten(Result)
multiplication_10 = Multiplication(A=item_9, B=python_3.out)  # -> flatten(Result)
multiplication_11 = Multiplication(A=item_6, B=python_3.out)  # -> flatten(Result)
panel_8 = Panel(division_3)
panel_9 = Panel(multiplication_7)
panel_10 = Panel(multiplication_8)
panel_11 = Panel(multiplication_9)
panel_12 = Panel(multiplication_11)
panel_13 = Panel(multiplication_10)

# ----
# Front loads on frame / in purlins
# max of front wind (D+E) and side wind (A)
multiplication_12 = Multiplication(A=multiplication_3, B=-1)
multiplication_13 = Multiplication(A=multiplication_10, B=-1)
addition_2 = Addition(A=multiplication_11, B=multiplication_13)
max = Maximum(A=addition_2, B=multiplication_12)
wky_kn_m_2 = Panel(max)
multiplication_14 = Multiplication(A=multiplication_6, _1=-1)
multiplication_15 = Multiplication(A=multiplication_8, B=-1)
addition_3 = Addition(A=multiplication_5, B=multiplication_14)
max_2 = Maximum(A=addition_3, B=multiplication_15)
wkx_kn_m_2 = Panel(max_2)

# ----
# number of frames - restrictions
L = Number(hall_lenght_l_m)
_2 = Number(2)
_10 = Number(10)
division_4 = Division(A=L, _10=_10)
division_5 = Division(A=L, B=_2)
subtraction = Subtraction(A=division_5, B=division_4)
dom = ConstructDomain(DomainStart=division_5, DomainEnd=division_4)
addition_4 = Addition(A=subtraction, B=1)
series = Series(Start=division_4, Step=1, Count=addition_4)  # -> flatten(Series)
lng = ListLength(List=series)
subtraction_2 = Subtraction(A=lng, B=1)
multiplication_16 = Multiplication(NFRatio=nf_ratio, B=subtraction_2)
item_11 = ListItem(List=series, Index=0, Wrap=True)
addition_5 = Addition(A=multiplication_16, B=item_11)
round = Round(Number=addition_5)  # -> Nearest, Floor, Ceiling
division_6 = Division(A=L, N1=round.Nearest)
addition_6 = Addition(A=round.Nearest, B=1)

multiplication_17 = Multiplication(A=frame_span_s_jon_m, B=hall_lenght_l_m)

distance_between_frames_cc_m = Panel(division_6)
nf = Panel(addition_6)
nf_2 = Number(nf)

# ----
# snow zone selecter
initial_snow_load_kn_m_2 = Panel(list_3)
ct = Panel("1.0")
ce = Panel(exposure_coefficient_snowload)

# ----
# Loads
# material selecter
# material properties (names): fmk (MPa)
# ft0k (MPa)
# ft90k (MPa)
# fc0k (MPa)
# fc90k (MPa)
# fvk (MPa)
# frk (MPa)
# E0,05 (MPa)
# E90,05 (MPa)
# G05 (MPa)
# E0,mean (MPa)
# E90,mean (MPa)
# Gmean (MPa)
# rho,k (kg/m^3)
# rho,mean (kg/m^3)
split = TextSplit(Text=list_4, Separators=",")  # -> flatten(Result)
kdef = Panel("""0.6
0.8
2""")
multiplication_18 = Multiplication(A=dead_load_kn_m_2, B=distance_between_frames_cc_m)
material_properties_values = Panel(split)
item_12 = ListItem(List=material_properties_values, Index=13, Wrap=True)
split_2 = TextSplit(Text=load_duration_class, Separators=",")
multiplication_19 = Multiplication(A=live_load_kn_m_2, B=distance_between_frames_cc_m)
kdef_2 = ListItem(List=kdef, Index=list_7, Wrap=True)  # -> flatten(Item)
kmod = ListItem(List=split_2, Index=list_7, Wrap=True)  # -> flatten(Item)
live_load_kn_m = Panel(multiplication_19)
split_3 = SplitList(List=material_properties_values, Index=7)  # -> flatten(ListA), ListB
γm_glulam = Panel("1.25")
kmod_2 = Panel(kmod)
multiplication_20 = Multiplication(A=split_3.ListA, B=kmod_2)
division_7 = Division(A=multiplication_20, B=γm_glulam)
design_values_material_properties_mpa = Panel(division_7)

# ----
# Volume calculation
expression = Expression(bc=column_width_bc_bb_mm, hc=hc_bc_x_mm, H=height_h_m, Expression="hc*bc*H*10^(-6)")
multiplication_21 = Multiplication(A=expression, B=2)

# ----
# Load Combinations
# ULS-Combinations
# Area load
# Design wind loads (kN/m^2)
γd = Panel(list_6)
ξ = Panel("0.89")
γg = Panel("1.35")
γq = Panel("1.5")
snow_load_combination_factors_ψ0_2_s = Panel("""0.7
0.5
0.2""")
roofs_load_combination_factors_ψ0_2_q = Panel("""0
0
0""")
wind_load_combination_factors_ψ0_2_q = Panel("""0.6
0.2
0""")
item_13 = ListItem(List=snow_load_combination_factors_ψ0_2_s, Index=0, Wrap=True)
item_14 = ListItem(List=roofs_load_combination_factors_ψ0_2_q, Index=0, Wrap=True)
item_15 = ListItem(List=wind_load_combination_factors_ψ0_2_q, Index=0, Wrap=True)
expression_2 = Expression(wky=wky_kn_m_2, yQ=γq, Psi0w=item_15, Expression="wky*yQ*Psi0w")
expression_3 = Expression(wkz=wkx_kn_m_2, yQ=γq, Psi0w=item_15, Expression="wkz*yQ*Psi0w")

# ---- group: Section input dependent on service class
item_16 = ListItem(List=snow_load_combination_factors_ψ0_2_s, Index=2, Wrap=True)
item_17 = ListItem(List=roofs_load_combination_factors_ψ0_2_q, Index=2, Wrap=True)
kdef_3 = Panel(kdef_2)
panel_14 = Panel(item_16)
panel_15 = Panel(item_17)

# ----
# Load from wind on
# column from y direction
# Wind load distribution
# Point load from wind on
# each compression strut from y direction
# Point load from wind on
# each purlin from y direction
# Point load from wind on
# beam from x direction
# Load from wind on
# column from x direction
# Point load from wind on
# column base support from x direction
multiplication_22 = Multiplication(Wdx=expression_3, Cc=distance_between_frames_cc_m)
division_8 = Division(MB=hb_mm, _1000=1000)
wdf_per_frame_kn_m = Panel(multiplication_22)
addition_7 = Addition(A=height_h_m, HB=division_8)
expression_4 = Expression(wdx=multiplication_22, Hsmax=addition_7, Expression="wdx*Hsmax/2")
wdb_kn = Number(expression_4)
expression_5 = Expression(wdy=expression_2, S=frame_span_s_jon_m, Expression="wdy*S/2")
multiplication_23 = Multiplication(WdB=wdb_kn, B=1)
wdxc = Number(wdf_per_frame_kn_m)
wdcsup_kn = Number(expression_4)

# ----
# Lateral torsional buckling
# "Vippningskontroll"
item_18 = ListItem(List=material_properties_values, Index=7, Wrap=True)
fmk = ListItem(List=material_properties_values, Index=0, Wrap=True)
s_m = Panel(frame_span_s_jon_m)
panel_16 = Panel(item_18)  # "E0.05"
fmd = ListItem(List=design_values_material_properties_mpa, Index=0, Wrap=True)

# ----
# Moment resistance at the tapered edge - critical section
item_19 = ListItem(List=design_values_material_properties_mpa, Index=4, Wrap=True)
item_20 = ListItem(List=design_values_material_properties_mpa, Index=5, Wrap=True)
item_21 = ListItem(List=design_values_material_properties_mpa, Index=0, Wrap=True)

# ----
# Shear resistance at support
item_22 = ListItem(List=flatten(design_values_material_properties_mpa), Index=5, Wrap=True)
kcr_according_ec5 = Panel("0.67")

# ----
# List of utilization ratios
panel_17 = Panel("""η1 - shear capacity
η2 - bending capacity (critical section)
η3 - bending capacity (mid point)
η4 - tension perpendicular (mid point)
η5 - deflection (inst)
η6 - deflection (final)
η7 - lateral torional buckling
η8 - combined compression and bending""")
dom_2 = ConstructDomain(DomainStart=0, DomainEnd=1)
panel_18 = Panel(dom_2)
partition = PartitionList(List=panel_17, Size=1)  # -> simplify(Chunks)

# ----
# Beam deflection
item_23 = ListItem(List=material_properties_values, G0gmean=12, Wrap=True)
item_24 = ListItem(List=material_properties_values, E0gmean=10, Wrap=True)
q1_kn_m = Panel("1")
division_9 = Division(A=frame_span_s_jon_m, _375=0.375)
winst_limit_mm = Panel(division_9)
division_10 = Division(A=frame_span_s_jon_m, _300=0.3)
wg_limit_mm = Panel(division_10)

# ----
# Combined compression and bending
βc_glulam = Panel("0.1")
fc0k = ListItem(List=material_properties_values, Index=3, Wrap=True)
fc0d = ListItem(List=design_values_material_properties_mpa, Index=3, Wrap=True)
expression_6 = Expression(WdB=multiplication_23, hB=hb_mm, bB=bb_mm, Expression="(WdB*10^3)/(hB*bB)")

# ----
# Tension perpendicular-to-grain at mid-point
item_25 = ListItem(List=design_values_material_properties_mpa, Index=2, Wrap=True)

# ----
# Calculations
panel_19 = Panel(expression_6)
steel_rod_system_detan_e_and_s = STEELRODSYSTEMDETANEAndS()  # -> ft_rd_kn_9, mxx_d_in_mm_9, halfen_system_size_7, ft_rd_kn_7, mxx_d_in_mm_7, halfen_system_size_8, ft_rd_kn_8, mxx_d_in_mm_8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
item_26 = ListItem(List=design_values_material_properties_mpa, Index=1, Wrap=True)
ft0d = Number(item_26)
table_9_2_kf2 = Panel("80")

# ----
# Bracing
# DETAN-S
ft_rd_kn = Panel([steel_rod_system_detan_e_and_s.ft_rd_kn_9, steel_rod_system_detan_e_and_s.ft_rd_kn_7, steel_rod_system_detan_e_and_s.ft_rd_kn_8, steel_rod_system_detan_e_and_s.ft_rd_kn_6])
mxx_d_in_mm = Panel([steel_rod_system_detan_e_and_s.mxx_d_in_mm_9, steel_rod_system_detan_e_and_s.mxx_d_in_mm_7, steel_rod_system_detan_e_and_s.mxx_d_in_mm_8, steel_rod_system_detan_e_and_s.mxx_d_in_mm_6])
halfen_system_size = Panel([steel_rod_system_detan_e_and_s.halfen_system_size_7, steel_rod_system_detan_e_and_s.halfen_system_size_8, steel_rod_system_detan_e_and_s.halfen_system_size_9, steel_rod_system_detan_e_and_s.halfen_system_size_6])

# ----
# Connections
d_9mm_screw_lenght_lsc_mm = Panel("""180
200
220
240
260
280
300
320
340
360
380
400
440
480
520
560
600""")
d_11mm_screw_lenght_lsc_mm = Panel("""175
200
225
250
275
300
325
350
375
400
425
450
475
500
525
550
575
600
650
700
750
800
850
900
950
1000""")
d_13mm_screw_lenght_lsc_mm = Panel("""250
400
500
550
600
650
700
750
800
850
900
950
1000
1100
1200
1300
1400
1500""")
d_15mm_screw_lenght_lsc_mm = Panel("""600
700
800
900
1000
1200
1400
1600
1800
2000""")
d_16mm_screw_lenght_lsc_mm = Panel("""300
400
500
600
800""")
d_20mm_screw_lenght_lsc_mm = Panel("""600
700
800
1000
1200
1400""")
number_of_screws_n = Panel("4")
panel_20 = Panel("""20
16
15
13
11
9""")
hc = Number(multiplication)
kc_90_bb_400 = Panel("1.75")
kc_90_bb_400_2 = Panel("1")
item_27 = ListItem(List=material_properties_values, Index=4, Wrap=True)
python_5 = GhPythonScript(bB=bb_mm, kc1=kc_90_bb_400, kc2=kc_90_bb_400_2)  # -> kc_90, a
# ---------- python_5: Python ----------
__author__ = "ext-elisabet.gunnars"
__version__ = "2024.02.21"

if bB <= 400:
    A = kc1 
else:
    A = kc2
print A
# ---------- end python_5 ----------
num = Number(number_of_screws_n)
num_2 = Number(item_27)
num_3 = Number(panel_20)
addition_8 = Addition(Hc=hc_bc_x_mm, _30=30)
num_4 = Number(python_5.kc_90)
num_5 = Number(d_11mm_screw_lenght_lsc_mm)
num_6 = Number(d_9mm_screw_lenght_lsc_mm)
num_7 = Number(d_13mm_screw_lenght_lsc_mm)
num_8 = Number(d_15mm_screw_lenght_lsc_mm)
num_9 = Number(d_20mm_screw_lenght_lsc_mm)
num_10 = Number(d_16mm_screw_lenght_lsc_mm)
expression_7 = Expression(kc90=python_5.kc_90, bc=column_width_bc_bb_mm, lef=addition_8, fc90k=item_27, Expression="kc90*bc*lef*fc90k")
python_6 = GhPythonScript(
    bB=flatten(bb_mm),
    hc=flatten(hc),
    hB=flatten(hb_mm),
    fc90k=flatten(num_2),
    kc=flatten(num_4),
    lef=flatten(addition_8),
    n=flatten(num),
    bc=flatten(bb_mm),
    d=num_3,
    d20=num_9,
    d16=num_10,
    d15=num_8,
    d13=num_7,
    d11=num_5,
    d9=num_6)  # -> flatten(Out), Fc, dsc, lsc; inputs d: list, d20: list, d16: list, d15: list, d13: list, d11: list, d9: list
# ---------- python_6: Python ----------
__author__ = "ext-elisabet.gunnars"
__version__ = "2024.02.23"
import math


#Finding the biggest screw that fits and outputing its strenght
lsc1 = hB*0.9
for x in d:
    if x == 20 and lsc1 > 600:
        ab=13*x
        ah=15*x
        if (ab < bc or ab ==bc) and (ah < hc or ah == hc):
            Rki=87.46
            print 87.46
            d=x
            break
        else:
            continue
    if x == 16 and lsc1 > 500:
        ab=13*x
        ah=15*x
        if (ab < bc or ab ==bc) and (ah < hc or ah == hc):
            Rki=55.16
            print 55.16
            d=x
            break
        else:
            continue
    if x == 15:
        ab=11*x
        ah=10*x
        if (ab < bc or ab ==bc) and (ah < hc or ah == hc):
            Rki=42.86
            print 42.86
            d=x
            break
        else:
            continue
    if x == 13 and lsc1 < 600 or lsc1==600:
        ab=13*x
        ah=15*x
        if (ab < bc or ab ==bc) and (ah < hc or ah == hc):
            Rki=32.69
            print 32.69
            d=x
            break
        else:
            continue
    if x == 13 and lsc1 > 600:
        ab=11*x
        ah=10*x
        if (ab < bc or ab ==bc) and (ah < hc or ah == hc):
            Rki=32.69
            print 32.69
            d=x
            break
        else:
            continue
    if x == 11 and lsc1 < 600 or lsc1==600:
        ab=13*x
        ah=15*x
        if (ab < bc or ab ==bc) and (ah < hc or ah == hc):
            Rki=21.93
            print 21.93
            d=x
            break
        else:
            continue
    if x == 11 and lsc1 > 600:
        ab=11*x
        ah=13*x
        if (ab < bc or ab ==bc) and (ah < hc or ah == hc):
            Rki=21.93
            print 21.93
            d=x
            break
        else:
            continue
    if x == 9 and lsc1 < 520 or lsc1==520:
        ab=13*x
        ah=15*x
        if (ab < bc or ab ==bc) and (ah < hc or ah == hc):
            Rki=21.93
            print 21.93
            d=x
            break
        else:
            continue
    if x == 9 and lsc1 > 520:
        ab=11*x
        ah=13*x
        if (ab < bc or ab ==bc) and (ah < hc or ah == hc):
            Rki =21.93
            print 21.93
            d=x
            break
        else:
            continue
    else:
        print 'null'
    break


Fc=kc*bc*lef*fc90k+(n*Rki*1000)
print Fc
print d
#Find allowed lenght of screw
if d == 20:
    r=len(d20)
    h=hB*0.9
    for x in range(r):
        e=math.exp(3.3*(d20[x]/hB))
        R=bB*(hc+0.25*d20[x]*e)*fc90k
        if R > Fc and d20[x] < h:
            lsc=d20[x]
            print d20[x]
            break
        else:
            continue
if d == 16:
    r=len(d16)
    h=hB*0.9
    for x in range(r):
        e=math.exp(3.3*(d16[x]/hB))
        R=bB*(hc+0.25*d16[x]*e)*fc90k
        if R > Fc and d16[x] < h:
            lsc=d16[x]
            print d16[x]
            break
        else:
            continue
if d == 15:
    r=len(d15)
    h=hB*0.9
    for x in range(r):
        e=math.exp(3.3*(d15[x]/hB))
        R=bB*(hc+0.25*d15[x]*e)*fc90k
        if R > Fc and d15[x] < h:
            lsc=d15[x]
            print d15[x]
            break
        else:
            continue
if d == 13:
    r=len(d13)
    h=hB*0.9
    for x in range(r):
        e=math.exp(3.3*(d13[x]/hB))
        R=bB*(hc+0.25*d13[x]*e)*fc90k
        if R > Fc and d13[x] < h:
            lsc=d13[x]
            print d13[x]
            break
        else:
            continue
if d == 11:
    r=len(d11)
    h=hB*0.9
    for x in range(r):
        e=math.exp(3.3*(d11[x]/hB))
        R=bB*(hc+0.25*d11[x]*e)*fc90k
        if R > Fc and d11[x] < h:
            lsc=d11[x]
            print d11[x]
            break
        else:
            continue
if d == 9:
    r=len(d9)
    h=hB*0.9
    for x in range(r):
        e=math.exp(3.3*(d9[x]/hB))
        R=bB*(hc+0.25*d9[x]*e)*fc90k
        if R > Fc and d9[x] < h:
            lsc=d9[x]
            print d9[x]
            break

dsc=d
Fc=Fc
# ---------- end python_6 ----------
γm = Panel("1.3")
panel_21 = Panel(python_6.Out)
expression_8 = Expression(kmod=kmod_2, Fc90Rk=expression_7, gammam=γm, Expression="kmod*Fc90Rk/gammam")
expression_9 = Expression(kmod=kmod_2, Fc90Rk=python_6.Fc, gammam=γm, Expression="kmod*Fc90Rk/gammam")

# ----
# Compression and bending combined
division_11 = Division(A=height_h_m, _500=500)
km = Panel("0.7")
item_28 = ListItem(List=design_values_material_properties_mpa, Index=0, Wrap=True)
item_29 = ListItem(List=design_values_material_properties_mpa, Index=3, Wrap=True)

# ----
# List of utilization ratios - Columns
panel_22 = Panel("""η.c1 - buckling/ compression capacity (y)
η.c2 - buckling/ compression capacity (z)
η.c3 - combined bending and comrpession
η.c4 - deflection inst. (y)
η.c5 - deflection fin. (y)
η.c6 - shear at support in (y)""")
dom_3 = ConstructDomain(DomainStart=0, DomainEnd=1)
panel_23 = Panel(dom_3)
partition_2 = PartitionList(List=panel_22, Size=1)  # -> simplify(Chunks)

list_item = ListItem(List=material_properties_values, Index=7, Wrap=True)  # "E0.05"
fc0k_2 = ListItem(List=material_properties_values, Index=3, Wrap=True)
fc0d_2 = ListItem(List=design_values_material_properties_mpa, Index=3, Wrap=True)
βc_glulam_2 = Panel("0.1")
buckling_length_lbc_h = Panel(height_h_m)
expression_10 = Expression(bc=column_width_bc_bb_mm, hc=hc_bc_x_mm, Expression="hc*bc^3/12")
expression_11 = Expression(
    E005=list_item,
    Iz=expression_10,
    betac=βc_glulam_2,
    lbc=buckling_length_lbc_h,
    Expression="(π^2*((E005*Iz)/(betac*lbc*10^3)^2))*10^(-6)")
multiplication_24 = Multiplication(Bc=column_width_bc_bb_mm, Hc=hc_bc_x_mm)
expression_12 = Expression(Iz=expression_10, Ac=multiplication_24, Expression="(Iz/Ac)^(0.5)")
expression_13 = Expression(lbc=buckling_length_lbc_h, i=expression_12, Expression="(lbc*10^3)/i")
expression_14 = Expression(lambda=expression_13, fc0k=fc0k_2, E005=list_item, Expression="lambda/π*(fc0k/E005)^(0.5)")
expression_15 = Expression(Larelbc=expression_14, betac=βc_glulam_2, Expression="0.5*(1+betac*(Larelbc-0.3)+(Larelbc)^2)")
expression_16 = Expression(k=expression_15, Larelbc=expression_14, Expression="1/(k+(k^2-Larelbc^2)^0.5)")
smaller = SmallerThan(FirstNumber=expression_14, SecondNumber=0.3)  # -> SmallerThan, OrEqualTo
kc_for_λrelbc_0_3 = Panel("1")
kc = ListItem(List=[expression_16, kc_for_λrelbc_0_3], Index=0, Wrap=True)
multiplication_25 = Multiplication(Kc=kc, Fc0d=fc0d_2)
pcr_mn = Panel(expression_11)

# ----
# Column calculations according to EC5 and swedish national standards
# Buckling
list_item_2 = ListItem(List=material_properties_values, Index=7, Wrap=True)  # "E0.05"
fc0k_3 = ListItem(List=material_properties_values, Index=3, Wrap=True)
fc0d_3 = ListItem(List=design_values_material_properties_mpa, Index=3, Wrap=True)
buckling_length_lbc_h_2 = Panel(height_h_m)
βc_glulam_3 = Panel("0.1")
expression_17 = Expression(bc=column_width_bc_bb_mm, hc=hc_bc_x_mm, Expression="bc*hc^3/12")
expression_18 = Expression(
    E005=list_item_2,
    Iy=expression_17,
    betac=βc_glulam_3,
    lbc=buckling_length_lbc_h_2,
    Expression="(π^2*((E005*Iy)/(betac*lbc*10^3)^2))*10^(-6)")
multiplication_26 = Multiplication(Bc=column_width_bc_bb_mm, Hc=hc_bc_x_mm)
expression_19 = Expression(Iy=expression_17, Ac=multiplication_26, Expression="(Iy/Ac)^(0.5)")
expression_20 = Expression(lbc=buckling_length_lbc_h_2, i=expression_19, Expression="(lbc*10^3)/i")
expression_21 = Expression(lambda=expression_20, fc0k=fc0k_3, E005=list_item_2, Expression="lambda/π*(fc0k/E005)^(0.5)")
expression_22 = Expression(Larelbc=expression_21, betac=βc_glulam_3, Expression="0.5*(1+betac*(Larelbc-0.3)+(Larelbc)^2)")
expression_23 = Expression(k=expression_22, Larelbc=expression_21, Expression="1/(k+(k^2-Larelbc^2)^0.5)")
smaller_2 = SmallerThan(FirstNumber=expression_21, SecondNumber=0.3)  # -> SmallerThan, OrEqualTo
kc_for_λrelbc_0_3_2 = Panel("1")
kc_2 = ListItem(List=[expression_23, kc_for_λrelbc_0_3_2], Index=0, Wrap=True)
multiplication_27 = Multiplication(Kc=kc_2, Fc0d=fc0d_3)
pcr_mn_2 = Panel(expression_18)

# ----
# Deflection in y
expression_24 = Expression(
    WdB=multiplication_23,
    H=height_h_m,
    E=list_item,
    Iy=expression_17,
    wdxC=wdxc,
    Expression="((5*wdxC*(H*10^3)^4)/(384*E*Iy))")
division_12 = Division(A=height_h_m, _75=75)
division_13 = Division(A=height_h_m, _150=150)
multiplication_28 = Multiplication(A=division_12, _1000=1000)
multiplication_29 = Multiplication(A=division_13, _1000=1000)
panel_24 = Panel(multiplication_28)
panel_25 = Panel(multiplication_29)
h_displacement_mm = Panel(expression_24)
division_14 = Division(A=expression_24, B=multiplication_28)
division_15 = Division(A=expression_24, B=multiplication_29)
panel_26 = Panel(division_14)
panel_27 = Panel(division_15)

vmaxc = Number(wdcsup_kn)
vmaxyc_kn = Panel(vmaxc)

# ----
# Shear resistance at support
kcr_according_ec5_2 = Panel("0.67")
expression_25 = Expression(
    VmaxyC=vmaxc,
    bC=column_width_bc_bb_mm,
    kcr=kcr_according_ec5_2,
    hC=hc_bc_x_mm,
    Expression="(1.5*VmaxyC*10^3)/(bC*kcr*hC)")
item_30 = ListItem(List=flatten(design_values_material_properties_mpa), Index=5, Wrap=True)
division_16 = Division(Taud=expression_25, Fvd=item_30)
panel_28 = Panel(division_16)
shear_at_supports = Panel(expression_25)

# ----
# Necessary spring stifness / design stabilizing force in purlins
table_9_2_ks = Panel("4")
list_item_3 = ListItem(List=material_properties_values, Index=7, Wrap=True)  # "E0.05"

# ----
# kcrit unbraced system
item_31 = ListItem(List=material_properties_values, Index=7, Wrap=True)
fmk_2 = ListItem(List=material_properties_values, Index=0, Wrap=True)
s_m_2 = Panel(frame_span_s_jon_m)
panel_29 = Panel(item_31)  # "E0.05"

# ----
# determine bP min
item_32 = ListItem(List=design_values_material_properties_mpa, Index=0, Wrap=True)
item_33 = ListItem(List=design_values_material_properties_mpa, Index=5, Wrap=True)
kcr_according_ec5_3 = Panel("0.67")
fmk_3 = ListItem(List=material_properties_values, Index=0, Wrap=True)
possible_bp = Panel("""50
55
60
65
70
75
80
85
90
95
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""")
fvd = Number(item_33)
kcr = Number(kcr_according_ec5_3)
P = Number(possible_bp)
cc = Number(distance_between_frames_cc_m)
e005 = Number(list_item_3)
fmk_4 = Number(fmk_3)
fmd_2 = Number(item_32)

# ----
# compression stud
possible_bcsb = Panel("""50
55
60
65
70
75
80
85
90
95
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""")
fc0k_4 = ListItem(List=material_properties_values, Index=3, Wrap=True)
fc0d_4 = ListItem(List=design_values_material_properties_mpa, Index=3, Wrap=True)
βc_glulam_4 = Panel("0.1")
cc_2 = Number(distance_between_frames_cc_m)
fc0d_5 = Number(fc0d_4)
csb = Number(possible_bcsb)
fc0k_5 = Number(fc0k_4)
e005_2 = Number(list_item_3)
betac = Number(βc_glulam_4)

# ----
# List of utilization ratios
panel_30 = Panel("""ηP1 - purlins - compression
ηP2 - purlins - buckling (compression)
ηP3 - purlins - bending
ηP4 - purlins - shear
ηCS.fi -  Compression stud fire check""")
dom_4 = ConstructDomain(DomainStart=0, DomainEnd=1)
panel_31 = Panel(dom_4)
partition_3 = PartitionList(List=panel_30, Size=1)  # -> simplify(Chunks)

# ----
# Fire Calculations:
# Geometrical Reduction and Load Case (accidental)
list_item_4 = ListItem(List=snow_load_combination_factors_ψ0_2_s, Index=2, Wrap=True)
list_item_5 = ListItem(List=roofs_load_combination_factors_ψ0_2_q, Index=2, Wrap=True)
split_4 = SplitList(List=material_properties_values, Index=7)  # -> flatten(ListA), ListB
γm_fi_glulam = Panel("1")
kmod_fi = Panel("1")
ψfi_s = Panel(list_item_4)
ψfi_q = Panel(list_item_5)
panel_32 = Panel("1")  # "γQ.fi"
ξfi = Panel("1.0")
βn_glulam_mm_min = Panel("0.7")
panel_33 = Panel("1")  # "γG.fi"
k0 = Panel("1")
multiplication_30 = Multiplication(A=split_4.ListA, B=kmod_fi)
kfi = Panel("1.15")
multiplication_31 = Multiplication(A=list_5, Βn=βn_glulam_mm_min)
d0 = Panel("7")
expression_26 = Expression(bB=bb_mm, dcharn=multiplication_31, k0=k0, d0=d0, Expression="bB-2*(dcharn+k0*d0)")
expression_27 = Expression(hc=hc_bc_x_mm, dcharn=multiplication_31, k0=k0, d0=d0, Expression="hc-2*(dcharn+k0*d0)")
expression_28 = Expression(hB=hb_mm, dcharn=multiplication_31, k0=k0, d0=d0, Expression="hB-(dcharn+k0*d0)")
expression_29 = Expression(bc=column_width_bc_bb_mm, dcharn=multiplication_31, k0=k0, d0=d0, Expression="bc-2*(dcharn+k0*d0)")
division_17 = Division(A=multiplication_30, B=γm_fi_glulam)
multiplication_32 = Multiplication(A=kfi, B=division_17)
panel_34 = Panel(expression_28)  # "hB.fi"
panel_35 = Panel(expression_27)  # "hc.fi"
panel_36 = Panel(expression_26)  # "bB.fi"
panel_37 = Panel(expression_29)  # "bc.fi"
design_values_material_properties_mpa_2 = Panel(multiplication_32)

# ----
# Copying Frame into Frame System
addition_9 = Addition(A=nf_2, _1=-1)
division_18 = Division(A=hall_lenght_l_m, N1=addition_9)
panel_38 = Panel(division_18)
series_2 = Series(Start=pt, Step=division_18, Count=nf_2)
line = Line([column_a, beam, column_b])
partition_4 = PartitionList(List=series_2, Size=1)  # -> simplify(Chunks)
panel_39 = Panel(series_2)
Y = UnitY(Factor=partition_4)

# ----
# visualization bracing
panel_40 = Panel("""True
False""")

# ----
# visualization bracing
panel_41 = Panel("""True
False""")

# ----
# Lateral torsional buckling
# "Vippningskontroll"
s_m_3 = Panel(frame_span_s_jon_m)
item_34 = ListItem(List=material_properties_values, Index=7, Wrap=True)
fmk_5 = ListItem(List=material_properties_values, Index=0, Wrap=True)
panel_42 = Panel(item_34)  # "E0.05"
fmd_3 = ListItem(List=design_values_material_properties_mpa, Index=0, Wrap=True)

# ----
# Shear resistance at support
kcr_2 = Number(kcr_according_ec5)
item_35 = ListItem(List=flatten(design_values_material_properties_mpa_2), FvdFi=5, Wrap=True)

# ----
# Momen resistance at the tapered edge - critical section
item_36 = ListItem(List=design_values_material_properties_mpa_2, Index=4, Wrap=True)
item_37 = ListItem(List=design_values_material_properties_mpa_2, Index=5, Wrap=True)
item_38 = ListItem(List=design_values_material_properties_mpa_2, Index=0, Wrap=True)

# ----
# List of utilization ratios
panel_43 = Panel("""η1.fi - shear capacity
η2.fi - bending capacity (critical section)
η3.fi - bending capacity (mid point)
η4.fi - tension perpendicular (mid point)
η5.fi - lateral torional buckling""")
dom_5 = ConstructDomain(DomainStart=0, DomainEnd=1)
panel_44 = Panel(dom_5)
partition_5 = PartitionList(List=panel_43, Size=1)  # -> simplify(Chunks)

# ----
# Tension perpendicular-to-grain at mid-point
item_39 = ListItem(List=design_values_material_properties_mpa_2, Index=2, Wrap=True)

subtraction_3 = Subtraction(A=nf_2, B=1)
dom_6 = ConstructDomain(DomainStart=0, DomainEnd=subtraction_3)
range = Range(Domain=dom_6, Steps=subtraction_3)

# ----
# Visualization Tapered Beam
division_19 = Division(A=bb_mm, B=2000)
neg = Negative(Value=division_19)
X = UnitX(Factor=neg)
X_2 = UnitX(Factor=division_19)
move = Move(Geometry=pt_3, Motion=X)  # -> Geometry, Transform
move_2 = Move(Geometry=pt_2, Motion=X_2)  # -> Geometry, Transform
ln = Line(StartPoint=move.Geometry, EndPoint=move_2.Geometry)
mb_max_mm = Panel("3000")
division_20 = Division(A=hb_mm, B="1000")
pt_5 = Point([move.Geometry, move_2.Geometry])
division_21 = Division(A=mb_max_mm, B="1000")
expression_30 = Expression(hB=division_20, alpha=angle_apex_degree, L=frame_span_s_jon_m, Expression="hB+tan(alpha°)*L/2")  # -> flatten(R)
Z = UnitZ(Factor=division_20)
min = Minimum(A=expression_30, B=division_21)
midpt = CurveMiddle(Curve=ln)
move_3 = Move(Geometry=pt_5, Motion=Z)  # -> Geometry, Transform
item_40 = ListItem(List=move_3.Geometry, Index=0, Wrap=True)
item_41 = ListItem(List=move_3.Geometry, Index=1, Wrap=True)
Z_2 = UnitZ(Factor=min)
move_4 = Move(Geometry=midpt, Motion=Z_2)  # -> Geometry, Transform
multiplication_33 = Multiplication(A=min, B=1000)
round_2 = Round(Number=multiplication_33)  # -> Nearest, Floor, Ceiling
merge = Merge(
    Data1=move.Geometry,
    Data2=item_40,
    Data3=move_4.Geometry,
    Data4=item_41,
    Data5=move_2.Geometry,
    Data6=midpt,
    Data7=move.Geometry)
pline = PolyLine(Vertices=merge, Closed=False)
division_22 = Division(A=bb_mm, B="2000")
boundary = BoundarySurfaces(Edges=pline)  # -> flatten(Surfaces)
neg_2 = Negative(Value=division_22)
Y_2 = UnitY(Factor=division_22)
Y_3 = UnitY(Factor=neg_2)
extr = Extrude(Base=boundary, Direction=Y_2)
extr_2 = Extrude(Base=boundary, Direction=Y_3)
beam_cs = Brep(reverse([extr, extr_2]))

pt_6 = Point([merge, pt_4, pt])
move_5 = Move(Geometry=[line, pt_6], Motion=Y)  # -> Geometry, Transform

# ----
# Visualization Columns
panel_45 = Panel("1000")
item_42 = ListItem(List=pt_5, Index=1, Wrap=True)
division_23 = Division(Hc=hc_bc_x_mm, B=panel_45)
xy = XYPlane(Origin=item_42)
division_24 = Division(Bc=column_width_bc_bb_mm, B="1000")
division_25 = Division(A=division_23, B=-1)
division_26 = Division(A=division_24, B=-2)
rectangle = Rectangle(Plane=xy, XSize=division_23, YSize=division_24, Radius=0)  # -> Rectangle, Length
Y_4 = UnitY(Factor=division_26)
X_3 = UnitX(Factor=division_25)
move_6 = Move(Geometry=rectangle.Rectangle, Motion=Y_4)  # -> Geometry, Transform
move_7 = Move(Geometry=move_6.Geometry, Motion=X_3)  # -> Geometry, Transform
extrcrv = ExtrudeAlong(Base=move_7.Geometry, Curve=column_a)

# ----
# Visualization Columns
panel_46 = Panel("1000")
item_43 = ListItem(List=pt_5, Index=0, Wrap=True)
division_27 = Division(Hc=hc_bc_x_mm, B=panel_46)
xy_2 = XYPlane(Origin=item_43)
division_28 = Division(Bc=column_width_bc_bb_mm, B="1000")
division_29 = Division(A=division_28, B=-2)
rectangle_2 = Rectangle(Plane=xy_2, XSize=division_27, YSize=division_28, Radius=0)  # -> Rectangle, Length
Y_5 = UnitY(Factor=division_29)
move_8 = Move(Geometry=rectangle_2.Rectangle, Motion=Y_5)  # -> Geometry, Transform
extrcrv_2 = ExtrudeAlong(Base=move_8.Geometry, Curve=column_a)

actual_mb_mm = Panel(round_2.Nearest)

expression_31 = Expression(hB=hb_mm, MB=actual_mb_mm, bB=bb_mm, rho=item_12, Expression="((hB+(MB-hB)*0.5)*bB)*rho*9.81*10^(-9)")
ch_self_weight_beam_kn_m = Panel(expression_31)
addition_10 = Addition(A=multiplication_18, B=ch_self_weight_beam_kn_m)
dead_load_kn_m = Panel(addition_10)

expression_32 = Expression(MB=actual_mb_mm, hB=hb_mm, S=frame_span_s_jon_m, Expression="((MB-hB)/1000)/(S/2)")
atan = ArcTangent(Value=expression_32)
deg = Degrees(Radians=atan)
round_3 = Round(Number=deg)  # -> Nearest, Floor, Ceiling
frame_visualization = Move(Geometry=[extrcrv, extrcrv_2, beam_cs], Motion=Y)  # -> Geometry, Transform

actual_angle_apex_degrees = Panel(round_3.Nearest)

expression_33 = Expression(alpha=actual_angle_apex_degrees, Expression="0.8+(0.2/15°)*alpha°")
mu5_according_to_boverket = Panel(expression_33)
ch_snow_load_calculation = Expression(
    s0=initial_snow_load_kn_m_2,
    mu=mu5_according_to_boverket,
    Ce=ce,
    Ct=ct,
    cc=distance_between_frames_cc_m,
    Expression="s0*mu*Ce*Ct*cc")
ch_snow_load_sk_kn_m = Panel(ch_snow_load_calculation)

# ----
# Load Calculation
# Line load
# Line load
# Area load
ch_snow_load_calculation_2 = Expression(s0=initial_snow_load_kn_m_2, mu=mu5_according_to_boverket, Ce=ce, Ct=ct, Expression="s0*mu*Ce*Ct")
ch_snow_load_sk_kn_m_2 = Panel(ch_snow_load_calculation_2)

expression_34 = Expression(hB=hb_mm, S=frame_span_s_jon_m, alpha=actual_angle_apex_degrees, Expression="hB+0.33*(S*10^3)*tan(alpha°)")
expression_35 = Expression(bB=bb_mm, he=expression_34, Expression="(bB*he^3)/12")
expression_36 = Expression(
    q1=q1_kn_m,
    S=frame_span_s_jon_m,
    E0gmean=item_24,
    Ie=expression_35,
    G0mean=item_23,
    bB=bb_mm,
    hB=hb_mm,
    MB=actual_mb_mm,
    Expression="(5*q1*(S*10^3)^4)/(384*E0gmean*Ie)+0.35*((q1*(S*10^3)^2)/(G0mean*bB*(hB+MB)))")
multiplication_34 = Multiplication(W1=expression_36, Qk=live_load_kn_m)
multiplication_35 = Multiplication(W1=expression_36, Sk=ch_snow_load_sk_kn_m)
multiplication_36 = Multiplication(W1=expression_36, Gk=dead_load_kn_m)
expression_37 = Expression(
    wginst=multiplication_36,
    y0s=item_13,
    wsinst=multiplication_35,
    wqinst=multiplication_34,
    Expression="wginst+y0s*wsinst+wqinst")
expression_38 = Expression(
    wginst=multiplication_36,
    wsinst=multiplication_35,
    y0q=item_14,
    wqinst=multiplication_34,
    Expression="wginst+wsinst+Y0q*wqinst")
max_3 = Maximum(A=expression_37, B=expression_38)
expression_39 = Expression(
    winstmax=max_3,
    wginst=multiplication_36,
    wsinst=multiplication_35,
    y2s=panel_14,
    wqinst=multiplication_34,
    y2q=panel_15,
    kdef=kdef_3,
    Expression="winstmax+(wginst+wsinst*y2s+wqinst*y2q)*kdef")
wg_fin = Panel(expression_39)
division_30 = Division(WgFin=wg_fin, WgLimit=wg_limit_mm)
winst_max = Panel(max_3)
division_31 = Division(WinstMax=winst_max, WinstLimit=winst_limit_mm)
η5 = Panel(division_31)
η6 = Panel(division_30)
panel_47 = Panel(expression_36)

expression_40 = Expression(hB=hb_mm, MB=actual_mb_mm, bB=bb_mm, S=frame_span_s_jon_m, Expression="((hB+(MB-hB)*0.5)*bB)*10^(-6)*S")
addition_11 = Addition(A=expression_40, B=multiplication_21)

# ----
# Line model and
# volume calculation
multiplication_37 = Multiplication(A=addition_11, B=nf_2)

division_32 = Division(MB=actual_mb_mm, _1000=1000)
addition_12 = Addition(A=height_h_m, MB=division_32)
expression_41 = Expression(wdy=expression_2, Hmax=addition_12, Expression="wdy*Hmax/2")
wdy_kn_m = Panel(expression_41)
multiplication_38 = Multiplication(Wdy=expression_41, B=frame_span_s_jon_m)

expression_42 = Expression(
    yd=γd,
    Xi=ξ,
    yG=γg,
    gk=dead_load_kn_m,
    yQ=γq,
    sk=ch_snow_load_sk_kn_m,
    Psi0s=item_13,
    qk=live_load_kn_m,
    Expression="yd*(Xi*yG*gk+yQ*Psi0s*sk+yQ*qk)")
expression_43 = Expression(
    yd=γd,
    Xi=ξ,
    yG=γg,
    gk=dead_load_kn_m,
    yQ=γq,
    sk=ch_snow_load_sk_kn_m,
    Psi0q=item_14,
    qk=live_load_kn_m,
    Expression="yd*(Xi*yG*gk+yQ*sk+yQ*Psi0q*qk)")
max_4 = Maximum(A=expression_43, B=expression_42)
qed_uls_kn_m = Panel(max_4)
panel_48 = Panel([expression_43, expression_42])
expression_44 = Expression(
    yd=γd,
    Xi=ξ,
    yG=γg,
    gk=dead_load_kn_m_2,
    yQ=γq,
    sk=ch_snow_load_sk_kn_m_2,
    Psi0s=item_13,
    qk=live_load_kn_m_2,
    Expression="yd*(Xi*yG*gk+yQ*Psi0s*sk+yQ*qk)")
expression_45 = Expression(
    yd=γd,
    Xi=ξ,
    yG=γg,
    gk=dead_load_kn_m_2,
    yQ=γq,
    sk=ch_snow_load_sk_kn_m_2,
    Psi0q=item_14,
    qk=live_load_kn_m_2,
    Expression="yd*(Xi*yG*gk+yQ*sk+yQ*Psi0q*qk)")
max_5 = Maximum(A=expression_45, B=expression_44)

expression_46 = Expression(qEd=max_4, S=frame_span_s_jon_m, bB=bb_mm, kcr=kcr_according_ec5, hB=hb_mm, Expression="(1.5*qEd*S)/(2*bB*kcr*hB*10^-3)")
division_33 = Division(Taud=expression_46, Fvd=item_22)
η1 = Panel(division_33)
shear_at_supports_2 = Panel(expression_46)

expression_47 = Expression(S=frame_span_s_jon_m, hB=hb_mm, MB=actual_mb_mm, Expression="S*hB/(2*MB)")
expression_48 = Expression(hB=hb_mm, S=frame_span_s_jon_m, MB=actual_mb_mm, xdim=expression_47, Expression="hB*10^-3+(2/S)*(MB-hB)*xdim*10^-3")
expression_49 = Expression(qEd=max_4, xdim=expression_47, S=frame_span_s_jon_m, Expression="(qEd*xdim/2)*(S-xdim)")
expression_50 = Expression(bB=bb_mm, hdim=expression_48, Expression="bB*10^-3*hdim^2/6")
expression_51 = Expression(
    alpha=actual_angle_apex_degrees,
    MEddim=expression_49,
    Wdim=expression_50,
    Expression="(1-3.7*tan(alpha°)^2)*MEddim/Wdim*10^-3")
expression_52 = Expression(
    alpha=actual_angle_apex_degrees,
    MEddim=expression_49,
    Wdim=expression_50,
    Expression="(1+3.7*tan(alpha°)^2)*MEddim/Wdim*10^-3")
expression_53 = Expression(
    fmd=item_21,
    fvd=item_20,
    alpha=actual_angle_apex_degrees,
    fc90d=item_19,
    Expression="1/(1+(((fmd/(1.5*fvd))*tan(alpha°))^2)+((fmd/fc90d)*tan(alpha°)^2)^2)^0.5")
multiplication_39 = Multiplication(Kmα=expression_53, Fmd=item_21)
multiplication_40 = Multiplication(Kmα=expression_53, Fmd=item_21)
division_34 = Division(Σmαd=expression_51, FmdKmα=multiplication_39)
division_35 = Division(Σm0d=expression_52, FmdKmα=multiplication_40)
panel_49 = Panel(division_34)
xdim_m = Panel(expression_47)
panel_50 = Panel(division_35)
panel_51 = Panel(expression_48)
max_6 = Maximum(Η21=panel_50, Η22=panel_49)
η2 = Panel(max_6)

# ----
# Inner forces
expression_54 = Expression(qEd=qed_uls_kn_m, S=frame_span_s_jon_m, Expression="qEd*S^2/8")
expression_55 = Expression(qEd=qed_uls_kn_m, S=frame_span_s_jon_m, Expression="qEd*S/2")
mmax_dim_knm = Panel(expression_49)
mmax_knm = Panel(expression_54)
vmax_kn = Panel(expression_55)

# ----
# Moment resistance at mid-point
expression_56 = Expression(alpha=actual_angle_apex_degrees, Expression="1+1.4*tan(alpha°)+5.4*tan(alpha°)^2")
expression_57 = Expression(bB=bb_mm, MB=actual_mb_mm, Expression="bB*MB^2*10^-9/6")
expression_58 = Expression(kl=expression_56, Mmax=mmax_knm, WM=expression_57, Expression="(kl*Mmax/WM)*10^-3")
division_36 = Division(Σm0dM=expression_58, Fmd=item_21)
η3 = Panel(division_36)
σm0dm_mpa = Panel(expression_58)

expression_59 = Expression(bB=bb_mm, MB=actual_mb_mm, alpha=actual_angle_apex_degrees, Expression="bB*(MB^2)*(10^-9)*(1-(tan(alpha°)/4))")
expression_60 = Expression(bB=bb_mm, hB=hb_mm, S=frame_span_s_jon_m, MB=actual_mb_mm, Expression="(2/3)*(bB*hB*10^-6*S+bB*(MB-hB)*10^-6*S/2)")
expression_61 = Expression(alpha=actual_angle_apex_degrees, Expression="0.2*tan(alpha°)")
expression_62 = Expression(kp=expression_61, Mmax=mmax_knm, WM=expression_57, Expression="kp*Mmax/WM*10^-3")
min_2 = Minimum(A=expression_59, B=expression_60)
expression_63 = Expression(V=min_2, V0=v0, Expression="(V0/V)^0.2")
expression_64 = Expression(kdis=kdis, kvol=expression_63, ft90d=item_25, Expression="kdis*kvol*ft90d")
division_37 = Division(Σt90DM=expression_62, Fmd=expression_64)
η4 = Panel(division_37)

expression_65 = Expression(wdxC=wdxc, H=height_h_m, deltaimp=division_11, Vmax=vmax_kn, Expression="(wdxC*(H*10^3)^2/8)+(deltaimp*Vmax*10^6)")
expression_66 = Expression(deltaimp=division_11, Vmax=vmax_kn, Expression="(deltaimp*Vmax*10^6)")
expression_67 = Expression(MCy=expression_65, hC=hc_bc_x_mm, bC=column_width_bc_bb_mm, Expression="(MCy)/(hC*bC^2/6)")
expression_68 = Expression(Vmax=vmax_kn, bC=column_width_bc_bb_mm, hC=hc_bc_x_mm, Expression="Vmax*10^3/(bC*hC)")
expression_69 = Expression(MCz=expression_66, hC=hc_bc_x_mm, bC=column_width_bc_bb_mm, Expression="(MCz)/(bC*hC^2/6)")
expression_70 = Expression(
    sigmamy=expression_67,
    sigmamz=expression_69,
    fmd=item_28,
    sigmac=expression_68,
    fc0d=item_29,
    kcy=kc_2,
    km=km,
    Expression="km*(sigmamz/fmd)+(sigmamy/fmd)+sigmac/(fc0d*kcy)")
expression_71 = Expression(
    sigmamy=expression_67,
    sigmamz=expression_69,
    fmd=item_28,
    sigmac=expression_68,
    fc0d=item_29,
    kcz=expression_15,
    km=km,
    Expression="(sigmamz/fmd)+km*(sigmamy/fmd)+sigmac/(fc0d*kcz)")
max_7 = Maximum(A=expression_71, B=expression_70)
panel_52 = Panel(max_7)

division_38 = Division(MmaxyCNmm=expression_65, _106=1000000)
mmaxc = Number(division_38)
mmaxyc_knm = Panel(mmaxc)

division_39 = Division(MmaxzCNmm=expression_66, _106=1000000)
mmaxc_2 = Number(division_39)
mmaxzc_knm = Panel(mmaxc_2)

expression_72 = Expression(Vmax=vmax_kn, Ac=multiplication_24, Expression="(Vmax*10^3)/Ac")
division_40 = Division(ΣcColumn=expression_72, ΣcD=multiplication_25)
panel_53 = Panel(division_40)

expression_73 = Expression(Vmax=vmax_kn, Ac=multiplication_26, Expression="(Vmax*10^3)/Ac")
division_41 = Division(ΣcColumn=expression_73, ΣcD=multiplication_27)
panel_54 = Panel(division_41)

merge_2 = Merge(Data1=panel_54, Data2=panel_53, Data3=panel_52, Data4=panel_27, Data5=panel_26, Data6=panel_28)
inc = Includes(Value=merge_2, Domain=panel_23)  # -> Includes, Deviation
panel_55 = Panel(merge_2)
panel_56 = Panel(inc.Includes)
partition_6 = PartitionList(List=panel_55, Size=1)  # -> simplify(Chunks)
partition_7 = PartitionList(List=panel_56, Size=1)  # -> simplify(Chunks)
panel_57 = Panel(partition_7)
merge_3 = Merge(Data1=partition_2, Data2=partition_7, Data3=partition_6)  # -> simplify(Result)
panel_58 = Panel(merge_3)

multiplication_41 = Multiplication(VmaxKN=expression_55, _1000=1000)
division_42 = Division(A=multiplication_41, B=expression_8)  # -> flatten(Result)
panel_59 = Panel(division_42)
division_43 = Division(A=multiplication_41, B=expression_9)
python_7 = GhPythonScript(μcon1=division_42, μcon2=division_43, dsc=python_6.dsc, lsc=python_6.lsc)  # -> μ7, dsc, lsc, a
# ---------- python_7: Python ----------
__author__ = "ext-elisabet.gunnars"
__version__ = "2024.02.21"

if μcon1 >= 1:
    A = μcon2
    if dsc == 9 or dsc== 11 or dsc ==13 or dsc == 15:
        a = '4 VGS screws from Rothoblass needed.'
        lsc=lsc
    else:
        a = '4 RTR screws from Rothoblass needed.'
        lsc=lsc
else:
    A = μcon1
    a= 'Without screw'
    lsc= ' '
    dsc= ' '
print A
# ---------- end python_7 ----------
η7 = Panel(python_7.μ7)

# ----
# Connections
beam_column_connection = Panel([python_7.a, "Diameter (mm)=", python_7.dsc, "Length(mm)=", python_7.lsc])

multiplication_42 = Multiplication(Hdim=expression_48, B=2)
addition_13 = Addition(A=s_m_2, B=multiplication_42)
expression_74 = Expression(bB=bb_mm, hdim=expression_48, Sef=addition_13, E005=panel_29, Expression="(0.78*(bB*10^(-3))^2)/(hdim*Sef)*E005")
expression_75 = Expression(fmk=fmk_2, sigmacr=expression_74, Expression="(fmk/sigmacr)^0.5")
num_11 = Number(expression_75)
python_8 = GhPythonScript(λrelm=num_11)  # -> flatten(kcritu), a
# ---------- python_8: Python ----------
__author__ = "ext-verena.gerl"
__version__ = "2024.02.26"

import rhinoscriptsyntax as rs
import math

x = λrelm
a = 1.56 - (0.75*x)
b = 1 / (x*x)

if x < 0.75 or x == 0.75:
    print 1

if 0.75 < x < 1.4:
    print a
    
if 1.4 < x:
    print b
# ---------- end python_8 ----------
panel_60 = Panel(expression_75)
kcrit_u_unbraced = Panel(python_8.kcritu)
panel_61 = Panel(expression_74)

# ----
# Parameter Choices/ Settings
# and Optimization
results_columns_utilization_ratios = Panel(panel_58)

σmαd_mpa = Panel(expression_51)
multiplication_43 = Multiplication(Hdim=expression_48, B=2)

num_12 = Number(actual_mb_mm)
expression_76 = Expression(hB=hb_mm, MB=num_12, Expression="(hB+MB)/2")
expression_77 = Expression(hav=expression_76, bB=bb_mm, Expression="hav*bB^3/12")
multiplication_44 = Multiplication(BB=bb_mm, Hmean=expression_76)
expression_78 = Expression(Iz=expression_77, AB=multiplication_44, Expression="(Iz/AB)^(0.5)")
expression_79 = Expression(S=frame_span_s_jon_m, iz=expression_78, Expression="(S*10^3)/iz")
expression_80 = Expression(lambdaz=expression_79, fc0k=fc0k, E005=list_item_3, Expression="lambdaz/π*(fc0k/E005)^(0.5)")
expression_81 = Expression(Larelz=expression_80, betac=βc_glulam, Expression="0.5*(1+betac*(Larelz-0.3)+(Larelz)^2)")
expression_82 = Expression(kz=expression_81, Larelz=expression_80, Expression="1/(kz+(kz^2-Larelz^2)^0.5)")

# ----
# Purlin calculations
expression_83 = Expression(kcritu=python_8.kcritu, Mmax=mmax_knm, MB=actual_mb_mm, Expression="(1-kcritu)*Mmax/(MB*10^-3)")
addition_14 = Addition(Nd=expression_83, WdB=multiplication_23)

division_44 = Division(HBmean=expression_76, _1000=1000)
expression_84 = Expression(
    n=nf_2,
    Mmax=mmax_knm,
    hBmean=division_44,
    S=frame_span_s_jon_m,
    kcritu=python_8.kcritu,
    Expression="(n-1)*(Mmax/(30*hBmean*S))*(1-kcritu)")

# ----
# Steel bar wall
expression_85 = Expression(wdyC=expression_5, Hmax=addition_12, Expression="wdyC*Hmax/2")
expression_86 = Expression(Hmax=addition_12, cc=distance_between_frames_cc_m, Expression="atan(cc*2/Hmax)*180/π")
steel_bar_angle_wall = Panel(expression_86)

division_45 = Division(A=addition_14, B=table_9_2_kf2)
multiplication_45 = Multiplication(Fc=division_45, _1000=1000)

expression_87 = Expression(MB=actual_mb_mm, dcharn=multiplication_31, k0=k0, d0=d0, Expression="MB-(dcharn+k0*d0)")
expression_88 = Expression(
    yd=γd,
    Xifi=ξfi,
    yGfi=panel_33,
    gk=dead_load_kn_m,
    yQfi=panel_32,
    Psifiq=ψfi_q,
    qk=live_load_kn_m,
    Psifis=ψfi_s,
    sk=ch_snow_load_sk_kn_m,
    Expression="yd*(Xifi*yGfi*gk+yQfi*Psifiq*qk+yQfi*Psifis*sk)")
panel_62 = Panel(expression_88)
panel_63 = Panel(expression_87)  # "MB.fi"

expression_89 = Expression(
    qEdfi=expression_88,
    S=frame_span_s_jon_m,
    bBfi=expression_26,
    kcr=kcr_2,
    hBfi=expression_28,
    Expression="(1.5*(qEdfi)*S)/(2*(bBfi)*kcr*(hBfi)*10^-3)")
division_46 = Division(TaudFi=expression_89, FvdFi=item_35)
shear_at_supports_3 = Panel(expression_89)
panel_64 = Panel(division_46)  # "η1.fi"

expression_90 = Expression(S=frame_span_s_jon_m, hBfi=expression_28, MBfi=expression_87, Expression="S*(hBfi)/(2*MBfi)")
expression_91 = Expression(qEdfi=expression_88, xdimfi=expression_90, S=frame_span_s_jon_m, Expression="((qEdfi)*(xdimfi)/2)*(S-(xdimfi))")
expression_92 = Expression(
    hBfi=expression_28,
    S=frame_span_s_jon_m,
    MBfi=expression_87,
    xdimfi=expression_90,
    Expression="hBfi*10^-3+(2/S)*(MBfi-hBfi)*xdimfi*10^-3")
expression_93 = Expression(bBfi=expression_26, hdimfi=expression_92, Expression="bBfi*10^-3*hdimfi^2/6")
expression_94 = Expression(
    alpha=actual_angle_apex_degrees,
    MEddim=expression_91,
    Wdim=expression_93,
    Expression="(1-3.7*tan(alpha°)^2)*MEddim/Wdim*10^-3")
expression_95 = Expression(
    alpha=actual_angle_apex_degrees,
    MEddim=expression_91,
    Wdim=expression_93,
    Expression="(1+3.7*tan(alpha°)^2)*MEddim/Wdim*10^-3")
expression_96 = Expression(
    fmd=item_38,
    fvd=item_37,
    alpha=actual_angle_apex_degrees,
    fc90d=item_36,
    Expression="1/(1+(((fmd/(1.5*fvd))*tan(alpha°))^2)+((fmd/fc90d)*tan(alpha°)^2)^2)^0.5")
multiplication_46 = Multiplication(Kmα=expression_96, Fmd=item_38)
multiplication_47 = Multiplication(Kmα=expression_96, Fmd=item_38)
division_47 = Division(Σmαd=expression_94, FmdKmα=multiplication_46)
division_48 = Division(Σm0d=expression_95, FmdKmα=multiplication_47)
panel_65 = Panel(division_47)
xdim_fi_m = Panel(expression_90)
panel_66 = Panel(division_48)
max_8 = Maximum(Η21=panel_66, Η22=panel_65)
panel_67 = Panel(max_8)  # "η2.fi"

# ----
# BEAM - Fire Calculations according to EC5 and swedish national standards
# Inner forces
expression_97 = Expression(qEdfi=expression_88, S=frame_span_s_jon_m, Expression="(qEdfi)*S^2/8")
expression_98 = Expression(qEdfi=expression_88, S=frame_span_s_jon_m, Expression="(qEdfi)*S/2")
mmax_dim_fi_knm = Panel(expression_91)
mmax_fi_knm = Panel(expression_97)
vmax_fi_kn = Panel(expression_98)

# ----
# Moment resistance at mid-point
expression_99 = Expression(bBfi=expression_26, MBfi=expression_87, Expression="(bBfi)*(MBfi)^2*10^-9/6")
expression_100 = Expression(alpha=actual_angle_apex_degrees, Expression="1+1.4*tan(alpha°)+5.4*tan(alpha°)^2")
expression_101 = Expression(kl=expression_100, Mmaxfi=expression_97, WM=expression_99, Expression="(kl*Mmaxfi/WM)*10^-3")
division_49 = Division(Σm0dM=expression_101, Fmd=item_38)
panel_68 = Panel(division_49)  # "η3.fi"
σm0dm_mpa_2 = Panel(expression_101)

expression_102 = Expression(
    bBfi=expression_26,
    hBfi=expression_28,
    S=frame_span_s_jon_m,
    MBfi=expression_87,
    Expression="(2/3)*((bBfi)*(hBfi)*10^-6*S+(bBfi)*((MBfi)-(hBfi))*10^-6*S/2)")
expression_103 = Expression(
    bBfi=expression_26,
    MBfi=expression_87,
    alpha=actual_angle_apex_degrees,
    Expression="(bBfi)*((MBfi)^2)*(10^-9)*(1-(tan(alpha°)/4))")
expression_104 = Expression(alpha=actual_angle_apex_degrees, Expression="0.2*tan(alpha°)")
expression_105 = Expression(kp=expression_104, Mmaxfi=expression_97, WM=expression_99, Expression="kp*Mmaxfi/WM*10^-3")
min_3 = Minimum(A=expression_103, B=expression_102)
expression_106 = Expression(V=min_3, V0=v0_2, Expression="(V0/V)^0.2")
expression_107 = Expression(kdis=kdis_2, kvol=expression_106, ft90d=item_39, Expression="kdis*kvol*ft90d")
division_50 = Division(Σt90DM=expression_105, Fmd=expression_107)
panel_69 = Panel(division_50)  # "η4.fi"

βc_glulam_5 = Panel("0.1")
buckling_length_lbc_h_3 = Panel(height_h_m)
# Column - Fire Calculations according to EC5 and swedisch national standards
list_item_6 = ListItem(List=material_properties_values, Index=7, Wrap=True)  # "E0.05"
fc0d_6 = ListItem(List=design_values_material_properties_mpa, Index=3, Wrap=True)
fc0k_6 = ListItem(List=material_properties_values, Index=3, Wrap=True)
expression_108 = Expression(bcfi=panel_37, hcfi=panel_35, Expression="bcfi*hcfi^3/12")
expression_109 = Expression(
    E005=list_item_6,
    Iyfi=expression_108,
    betac=βc_glulam_5,
    lbc=buckling_length_lbc_h_3,
    Expression="(π^2*((E005*Iyfi)/(betac*lbc*10^3)^2))*10^(-6)")
multiplication_48 = Multiplication(Bcfi=panel_37, Hcfi=panel_35)
expression_110 = Expression(Vmaxfi=vmax_fi_kn, Acfi=multiplication_48, Expression="(Vmaxfi*10^3)/Acfi")
expression_111 = Expression(Iyfi=expression_108, Acfi=multiplication_48, Expression="(Iyfi/Acfi)^(0.5)")
expression_112 = Expression(lbc=buckling_length_lbc_h_3, ifi=expression_111, Expression="(lbc*10^3)/ifi")
expression_113 = Expression(lambda=expression_112, fc0k=fc0k_6, E005=list_item_6, Expression="lambda/π*(fc0k/E005)^(0.5)")
expression_114 = Expression(Larelbc=expression_113, betac=βc_glulam_5, Expression="0.5*(1+betac*(Larelbc-0.3)+(Larelbc)^2)")
expression_115 = Expression(k=expression_114, Larelbc=expression_113, Expression="1/(k+(k^2-Larelbc^2)^0.5)")
smaller_3 = SmallerThan(FirstNumber=expression_113, SecondNumber=0.3)  # -> SmallerThan, OrEqualTo
kc_for_λrelbc_0_3_3 = Panel("1")
kc_3 = ListItem(List=[expression_115, kc_for_λrelbc_0_3_3], Index=0, Wrap=True)
multiplication_49 = Multiplication(Kc=kc_3, Fc0d=fc0d_6)
division_51 = Division(ΣcColumn=expression_110, ΣcD=multiplication_49)
panel_70 = Panel(kc_3)
η_c1fi = Panel(division_51)
pcr_mn_3 = Panel(expression_109)

list_item_7 = ListItem(List=material_properties_values, Index=7, Wrap=True)  # "E0.05"
fc0k_7 = ListItem(List=material_properties_values, Index=3, Wrap=True)
fc0d_7 = ListItem(List=design_values_material_properties_mpa, Index=3, Wrap=True)
βc_glulam_6 = Panel("0.1")
buckling_length_lbc_h_4 = Panel(height_h_m)
expression_116 = Expression(bcfi=panel_37, hcfi=panel_35, Expression="hcfi*bcfi^3/12")
expression_117 = Expression(
    E005=list_item_7,
    Izfi=expression_116,
    betac=βc_glulam_6,
    lbc=buckling_length_lbc_h_4,
    Expression="(π^2*((E005*Izfi)/(betac*lbc*10^3)^2))*10^(-6)")
multiplication_50 = Multiplication(Bcfi=panel_37, Hcfi=panel_35)
expression_118 = Expression(Vmaxfi=vmax_fi_kn, Acfi=multiplication_50, Expression="(Vmaxfi*10^3)/Acfi")
expression_119 = Expression(Izfi=expression_116, Acfi=multiplication_50, Expression="(Izfi/Acfi)^(0.5)")
expression_120 = Expression(lbc=buckling_length_lbc_h_4, ifi=expression_119, Expression="(lbc*10^3)/ifi")
expression_121 = Expression(lambda=expression_120, fc0k=fc0k_7, E005=list_item_7, Expression="lambda/π*(fc0k/E005)^(0.5)")
expression_122 = Expression(Larelbc=expression_121, betac=βc_glulam_6, Expression="0.5*(1+betac*(Larelbc-0.3)+(Larelbc)^2)")
expression_123 = Expression(k=expression_122, Larelbc=expression_121, Expression="1/(k+(k^2-Larelbc^2)^0.5)")
smaller_4 = SmallerThan(FirstNumber=expression_121, SecondNumber=0.3)  # -> SmallerThan, OrEqualTo
kc_for_λrelbc_0_3_4 = Panel("1")
kc_4 = ListItem(List=[expression_123, kc_for_λrelbc_0_3_4], Index=0, Wrap=True)
multiplication_51 = Multiplication(Kc=kc_4, Fc0d=fc0d_7)
division_52 = Division(ΣcColumn=expression_118, ΣcD=multiplication_51)
panel_71 = Panel(kc_4)
η_c1fi_2 = Panel(division_52)
pcr_mn_4 = Panel(expression_117)

# ----
# List of utilization ratios
panel_72 = Panel("""η.c1.fi - buckling/ compression capacity (y)
η.c2.fi - buckling/ compression capacity (z)""")
dom_7 = ConstructDomain(DomainStart=0, DomainEnd=1)
merge_4 = Merge(Data1=η_c1fi, Data2=η_c1fi_2)
panel_73 = Panel(dom_7)
inc_2 = Includes(Value=merge_4, Domain=panel_73)  # -> Includes, Deviation
panel_74 = Panel(merge_4)
panel_75 = Panel(inc_2.Includes)
partition_8 = PartitionList(List=panel_72, Size=1)  # -> simplify(Chunks)
partition_9 = PartitionList(List=panel_75, Size=1)  # -> simplify(Chunks)
partition_10 = PartitionList(List=panel_74, Size=1)  # -> simplify(Chunks)
merge_5 = Merge(Data1=partition_8, Data2=partition_9, Data3=partition_10)
panel_76 = Panel(partition_9)

# ----
# Bracing - Fire Calculations according to EC5 and swedisch national standards
# kcrit unbraced system
item_44 = ListItem(List=material_properties_values, Index=7, Wrap=True)
fmk_6 = ListItem(List=material_properties_values, Index=0, Wrap=True)
s_m_4 = Panel(frame_span_s_jon_m)
multiplication_52 = Multiplication(Hdimfi=expression_92, B=2)
panel_77 = Panel(item_44)  # "E0.05"
addition_15 = Addition(A=s_m_4, B=multiplication_52)
expression_124 = Expression(
    bBfi=panel_36,
    hdimfi=expression_92,
    Sef=addition_15,
    E005=panel_77,
    Expression="(0.78*(bBfi*10^(-3))^2)/(hdimfi*Sef)*E005")
expression_125 = Expression(fmk=fmk_6, sigmacr=expression_124, Expression="(fmk/sigmacr)^0.5")
num_13 = Number(expression_125)
python_9 = GhPythonScript(λrelm=num_13)  # -> flatten(kcritu), a; same code as python_8
panel_78 = Panel(expression_125)
kcrit_u_unbraced_2 = Panel(python_9.kcritu)
panel_79 = Panel(expression_124)

results_columns_fire_calculation_utiliza = Panel(merge_5)  # "RESULTS: Columns -Fire calculation - Utilization Ratios"

line_copies = SubList(List=move_5.Geometry, Domain=Domain(0, 2), Wrap=True)  # -> simplify(List), Index
point_copies = SubList(List=move_5.Geometry, Domain=Domain(3, 11), Wrap=True)  # -> simplify(List), Index
item_45 = ListItem(List=point_copies.List, Index=1, Wrap=True)
item_46 = ListItem(List=point_copies.List, Index=3, Wrap=True)  # -> reverse(Item)
item_47 = ListItem(List=point_copies.List, Index=2, Wrap=True)
ln_2 = Line(StartPoint=item_46, EndPoint=item_47)
ln_3 = Line(StartPoint=item_45, EndPoint=item_47)
expression_126 = Expression(ec=ec_m_horizontal, alpha=actual_angle_apex_degrees, Expression="(ec)/(cos(alpha°))")
num_14 = Number(ln_3)
item_48 = TreeItem(Tree=num_14, Path="{0}", Index=0, Wrap=True)
division_53 = Division(A=num_14, B=expression_126)
round_4 = Round(Number=division_53)  # -> Nearest, Floor, Ceiling
item_49 = TreeItem(Tree=round_4.Nearest, Path="{0}", Index=0, Wrap=True)
division_54 = Division(A=item_48, B=item_49)
expression_127 = Expression(R=division_54, alpha=actual_angle_apex_degrees, Expression="(R)*(cos(alpha°))")

actual_ec = Panel(expression_127)

expression_128 = Expression(qEdp=max_5, ec=actual_ec, Expression="qEdp/ec")

# ----
# number of purlins
# number of purlins for bracing
division_55 = Division(A=frame_span_s_jon_m, Ec=actual_ec)
round_5 = Round(Number=division_55)  # -> Nearest, Floor, Ceiling
addition_16 = Addition(A=round_5.Nearest, B=1)
addition_17 = Addition(Np=addition_16, B=1)
division_56 = Division(Np=addition_17, B=2)
round_6 = Round(Number=division_56)  # -> Nearest, Floor, Ceiling
np_for_bracing = Panel(round_6.Ceiling)

multiplication_53 = Multiplication(Ec=actual_ec, B=2)
subtraction_4 = Subtraction(NP=addition_16, B=1)
multiplication_54 = Multiplication(Wdy=expression_41, _2ec=multiplication_53)
division_57 = Division(Wdy=multiplication_38, NP1=subtraction_4)
wdcs_per_purlin_kn = Panel(multiplication_54)
wdp_per_purlin_kn = Panel(division_57)

expression_129 = Expression(qh=expression_84, ec=actual_ec, Expression="qh*2*ec")
division_58 = Division(WdCS=multiplication_54, B=2)
division_59 = Division(A=multiplication_45, NP=round_6.Ceiling)

multiplication_55 = Multiplication(Ec=actual_ec, _2000=2000)  # disabled
expression_130 = Expression(
    E005=list_item_3,
    Imean=expression_77,
    ec=actual_ec,
    S=frame_span_s_jon_m,
    Expression="(((π^(2)*E005*Imean)/(S*10^3*2)^2)*10^(-3))")  # disabled
expression_131 = Expression(ks=table_9_2_ks, Nd=expression_83, ec=actual_ec, Expression="(ks*Nd*10^3)/(2*ec*10^3)")  # disabled
division_60 = Division(Ec2=multiplication_55, _500=500)  # disabled
expression_132 = Expression(w0=division_60, NmaxB=addition_14, NBcr=expression_130, Expression="w0/(1-(NmaxB/NBcr))")  # disabled
multiplication_56 = Multiplication(A=expression_131, B=expression_132)  # disabled
panel_80 = Panel(expression_130)
division_61 = Division(FcP=division_59, _1000=1000)
fc_kn = Panel(division_61)

# ----
# max NdP per purlin including necessary stiffness for buckling restriction
multiplication_57 = Multiplication(WdP=wdp_per_purlin_kn, _1000=1000)
addition_18 = Addition(WdP=multiplication_57, Fc=division_59)

addition_19 = Addition(WdCS05=division_58, Qh=expression_129)  # -> flatten(Result)
expression_133 = Expression(np=np_for_bracing, P=addition_19, Expression="(np-1)*P/2")
python_10 = GhPythonScript(CSB=csb, cc=cc_2, fc0d=fc0d_5, fc0k=fc0k_5, E005=e005_2, betac=betac, Rd=expression_133)  # -> flatten(out), a; inputs CSB: list
# ---------- python_10: Python ----------
__author__ = "ext-verena.gerl"
__version__ = "2024.03.12"

import rhinoscriptsyntax as rs
import math

for x in CSB:
    bS = x
    hS = 1*bS
    AS = bS*hS
    Iz = hS*bS**3/12
    i = (Iz/AS)**(0.5)
    lam = (cc*10**3)/i
    lambdarel = lam/math.pi*(fc0k/E005)**(0.5)
    k = 0.5*(1+betac*(lambdarel-0.3)+(lambdarel)**2)
    kc = 1/(k+(k**2-lambdarel**2)**0.5) 
    eta = (Rd*10**3)/(kc*AS*fc0d)
    
    if eta < 1 or eta == 1:
        print x 
        break 
    else:
        continue
# ---------- end python_10 ----------
design_load_into_each_strut_kn = Panel(addition_19)
force_actting_on_struts_at_support_rd_kn = Panel(expression_133)
multiplication_58 = Multiplication(A=python_10.out, B=1)
bcs_mm = Panel(python_10.out)
hcs_mm = Panel(multiplication_58)
expression_134 = Expression(hCS=hcs_mm, bCS=bcs_mm, Expression="hCS^3*bCS/12")
expression_135 = Expression(E005=panel_29, ICS=expression_134, cc=distance_between_frames_cc_m, Expression="(π^2*E005*ICS/((cc*10^3)^2))*10^-3")
critical_load_purlin = Panel(expression_135)

# ----
# Steel bar roof
expression_136 = Expression(ec=actual_ec, cc=distance_between_frames_cc_m, Expression="atan(ec*2/cc)*180/π")
expression_137 = Expression(R=expression_133, P=design_load_into_each_strut_kn, beta=expression_136, Expression="(R-P/2)/cos(beta°)")
steel_bar_angle_roof = Panel(expression_136)
panel_81 = Panel(expression_137)
larger = LargerThan(FirstNumber=ft_rd_kn, SecondNumber=expression_137)  # -> LargerThan, OrEqualTo
dispatch = Dispatch(List=halfen_system_size, DispatchPattern=larger.LargerThan)  # -> ListA, ListB
dispatch_2 = Dispatch(List=mxx_d_in_mm, DispatchPattern=larger.LargerThan)  # -> ListA, ListB
item_50 = ListItem(List=dispatch.ListA, Index=0, Wrap=True)
item_51 = ListItem(List=dispatch_2.ListA, Index=0, Wrap=True)
halfen_system = Panel(item_50)
d_mm = Panel(item_51)

expression_138 = Expression(
    R=expression_133,
    P=design_load_into_each_strut_kn,
    WdyC=expression_85,
    beta=expression_86,
    Expression="(R+WdyC)/cos(beta°)")
panel_82 = Panel(expression_138)
larger_2 = LargerThan(FirstNumber=ft_rd_kn, SecondNumber=expression_138)  # -> LargerThan, OrEqualTo
dispatch_3 = Dispatch(List=halfen_system_size, DispatchPattern=larger_2.LargerThan)  # -> ListA, ListB
dispatch_4 = Dispatch(List=mxx_d_in_mm, DispatchPattern=larger_2.LargerThan)  # -> ListA, ListB
item_52 = ListItem(List=dispatch_3.ListA, Index=0, Wrap=True)
item_53 = ListItem(List=dispatch_4.ListA, Index=0, Wrap=True)
d_mm_2 = Panel(item_53)
halfen_system_2 = Panel(item_52)

# ----
# Bracing system
d_mm_steel_rod_roof = Panel(d_mm)
halfen_system_roof = Panel(halfen_system)
bcs_mm_2 = Panel(bcs_mm)
hcs_mm_2 = Panel(hcs_mm)
d_mm_steel_rod_wall = Panel(d_mm_2)
halfen_system_wall = Panel(halfen_system_2)

expression_139 = Expression(bCS=bcs_mm_2, dcharn=multiplication_31, k0=k0, d0=d0, Expression="bCS-2*(dcharn+k0*d0)")
expression_140 = Expression(hCS=hcs_mm_2, dcharn=multiplication_31, k0=k0, d0=d0, Expression="hCS-2*(dcharn+k0*d0)")
bcs_fi = Panel(expression_139)
hcs_fi = Panel(expression_140)

ec_m = Panel(actual_ec)
σmαd_mpa_2 = Panel(expression_94)
multiplication_59 = Multiplication(Hdimfi=expression_92, B=2)
multiplication_60 = Multiplication(A=ec_m, B=2)
addition_20 = Addition(A=multiplication_60, B=multiplication_59)
expression_141 = Expression(
    bBfi=expression_26,
    hdimfi=expression_92,
    lef=addition_20,
    E005=panel_42,
    Expression="((0.78*(bBfi*10^(-3))^2)/(hdimfi*lef))*E005")
expression_142 = Expression(fmk=fmk_5, sigmacr=expression_141, Expression="(fmk/sigmacr)^0.5")
num_15 = Number(expression_142)
python_11 = GhPythonScript(λrelm=num_15)  # -> kcrit, a; same code as python_8
expression_143 = Expression(sigma=σmαd_mpa_2, kcrit=python_11.kcrit, fmd=fmd_3, Expression="sigma/(kcrit*fmd)")  # -> flatten(η5_fi)
panel_83 = Panel(python_11.kcrit)
panel_84 = Panel(expression_143)  # "η5.fi"
mpa = Panel(expression_141)

merge_6 = Merge(Data1=panel_64, Data2=panel_67, Data3=panel_68, Data4=panel_69, Data5=panel_84)
inc_3 = Includes(Value=merge_6, Domain=panel_44)  # -> Includes, Deviation
panel_85 = Panel(merge_6)
panel_86 = Panel(inc_3.Includes)
partition_11 = PartitionList(List=panel_86, Size=1)  # -> simplify(Chunks)
partition_12 = PartitionList(List=panel_85, Size=1)  # -> simplify(Chunks)
merge_7 = Merge(Data1=partition_5, Data2=partition_11, Data3=partition_12)
panel_87 = Panel(partition_11)

dr = Number(d_mm_steel_rod_roof)
dw = Number(d_mm_steel_rod_wall)
python_12 = GhPythonScript(dw=dw, dr=dr)  # -> flatten(out), dwout, drout
# ---------- python_12: Python ----------
__author__ = "ext-verena.gerl"
__version__ = "2024.02.13"



if dw == None:
    dwout = 0
else:
    dwout = dw


if dr == None:
    drout = 0
else:
    drout = dr

print dwout
print drout
# ---------- end python_12 ----------
panel_88 = Panel(python_12.out)

results_beam_fire_calculation_utilizatio = Panel(merge_7)  # "RESULTS: BEAM - Fire calculation - Utilization Ratios"

number_of_purlins_np = Panel(addition_16)

expression_144 = Expression(hCS=hcs_mm_2, bCS=bcs_mm_2, cc=distance_between_frames_cc_m, nCS=np_for_bracing, Expression="10^-6*hCS*bCS*cc*nCS*2")

ec_m_2 = Panel(actual_ec)

# ----
# Beam Calculations according to EC5 and swedish national standards
multiplication_61 = Multiplication(A=ec_m_2, B=2)

addition_21 = Addition(A=multiplication_61, B=multiplication_43)
expression_145 = Expression(bB=bb_mm, hdim=expression_48, lef=addition_21, E005=panel_16, Expression="((0.78*(bB*10^(-3))^2)/(hdim*lef))*E005")
expression_146 = Expression(fmk=fmk, sigmacr=expression_145, Expression="(fmk/sigmacr)^0.5")
num_16 = Number(expression_146)
python_13 = GhPythonScript(λrelm=num_16)  # -> kcrit, a; same code as python_8
expression_147 = Expression(sigma=σmαd_mpa, kcrit=python_13.kcrit, fmd=fmd, Expression="sigma/(kcrit*fmd)")  # -> flatten(η7)
panel_89 = Panel(python_13.kcrit)
mpa_2 = Panel(expression_145)
η7_2 = Panel(expression_147)

expression_148 = Expression(n8=expression_147, sigmac=expression_6, kcz=expression_82, fc0d=fc0d, Expression="(n8)^2+sigmac/(kcz*fc0d)")
η8 = Panel(expression_148)

merge_8 = Merge(Data1=η1, Data2=η2, Data3=η3, Data4=η4, Data5=η5, Data6=η6, Data7=η7_2, Data8=η8)
inc_4 = Includes(Value=merge_8, Domain=panel_18)  # -> Includes, Deviation
panel_90 = Panel(merge_8)
panel_91 = Panel(inc_4.Includes)
partition_13 = PartitionList(List=flatten(panel_90), Size=1)  # -> simplify(Chunks)
partition_14 = PartitionList(List=panel_91, Size=1)  # -> simplify(Chunks)
merge_9 = Merge(Data1=partition, Data2=partition_14, Data3=partition_13)
panel_92 = Panel(partition_14)

results_beam_utilization_ratios = Panel(merge_9)

division_62 = Division(BCS=bcs_mm_2, _1000=1000)
division_63 = Division(HCS=hcs_mm_2, _1000=1000)
Z_3 = UnitZ(Factor=division_62)
neg_3 = Negative(Value=Z_3)
division_64 = Division(DSteelRoof=d_mm_steel_rod_roof, _2000=2000)
neg_4 = Negative(Value=division_62)
X_4 = UnitX(Factor=neg_4)
neg_5 = Negative(Value=division_63)
Z_4 = UnitZ(Factor=neg_5)

division_65 = Division(BCS=bcs_mm_2, _1000=1000)
division_66 = Division(HCS=hcs_mm_2, _1000=1000)
Z_5 = UnitZ(Factor=division_65)
neg_6 = Negative(Value=Z_5)
division_67 = Division(DSteelRoof=d_mm_steel_rod_roof, _2000=2000)
neg_7 = Negative(Value=division_65)
X_5 = UnitX(Factor=neg_7)
neg_8 = Negative(Value=division_66)
Z_6 = UnitZ(Factor=neg_8)

divide = DivideCurve(Curve=ln_3, Count=division_53, Kinks=False)  # -> Points, Tangents, Parameters
cull_i = CullIndex(List=reverse(simplify(divide.Points)), Indices=0, Wrap=True)  # -> reverse(List)
item_54 = ListItem(List=reverse(divide.Points), Index=0, Wrap=True)  # -> reverse(Item)

divide_2 = DivideCurve(Curve=ln_2, Count=division_53, Kinks=False)  # -> Points, Tangents, Parameters

item_55 = ListItem(List=point_copies.List, Index=7, Wrap=True)
item_56 = ListItem(List=point_copies.List, Index=8, Wrap=True)
flatten = FlattenTree(Tree=item_55, Path="{0}")
flatten_2 = FlattenTree(Tree=item_56, Path="{0}")
item_57 = ListItem(List=flatten, Index=1, Wrap=True)
item_58 = ListItem(List=flatten, Index=0, Wrap=True)
item_59 = ListItem(List=flatten_2, Index=0, Wrap=True)
item_60 = ListItem(List=flatten_2, Index=1, Wrap=True)
addition_22 = Addition(A=division_65, B=division_66)
Z_7 = UnitZ(Factor=addition_22)
neg_9 = Negative(Value=Z_7)
division_68 = Division(DSteelWall=d_mm_steel_rod_wall, _2000=2000)

item_61 = ListItem(List=point_copies.List, Index=7, Wrap=True)
item_62 = ListItem(List=point_copies.List, Index=8, Wrap=True)
flatten_3 = FlattenTree(Tree=item_61, Path="{0}")
flatten_4 = FlattenTree(Tree=item_62, Path="{0}")
rev = ReverseList(List=flatten_3)
rev_2 = ReverseList(List=flatten_4)
item_63 = ListItem(List=rev, Index=0, Wrap=True)
item_64 = ListItem(List=rev, Index=1, Wrap=True)
item_65 = ListItem(List=rev_2, Index=0, Wrap=True)
item_66 = ListItem(List=rev_2, Index=1, Wrap=True)
addition_23 = Addition(A=division_62, B=division_63)
Z_8 = UnitZ(Factor=addition_23)
neg_10 = Negative(Value=Z_8)
division_69 = Division(DSteelWall=d_mm_steel_rod_wall, _2000=2000)

# ----
# visualization purlins
panel_93 = Panel("1000")

# ----
# Bracing
# compression strut
expression_149 = Expression(hBfi=panel_34, MBfi=panel_63, Expression="(hBfi+MBfi)/2")
expression_150 = Expression(hCSfi=hcs_fi, bCSfi=bcs_fi, Expression="hCSfi^3*bCSfi/12")
possible_bcsb_2 = Panel("""50
55
60
65
70
75
80
85
90
95
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""")
division_70 = Division(HBmean=expression_149, _1000=1000)
βc_glulam_7 = Panel("0.1")
fc0k_8 = ListItem(List=material_properties_values, Index=3, Wrap=True)
fc0d_8 = ListItem(List=design_values_material_properties_mpa, Index=3, Wrap=True)
expression_151 = Expression(E005=panel_29, ICS=expression_150, cc=distance_between_frames_cc_m, Expression="(π^2*E005*ICS/((cc*10^3)^2))*10^-3")
expression_152 = Expression(
    n=nf_2,
    Mmaxfi=mmax_fi_knm,
    hBmean=division_70,
    S=frame_span_s_jon_m,
    kcritu=kcrit_u_unbraced_2,
    Expression="(n-1)*(Mmaxfi/(30*hBmean*S))*(1-kcritu)")
csb_2 = Number(possible_bcsb_2)
cc_3 = Number(distance_between_frames_cc_m)
fc0d_9 = Number(fc0d_8)
fc0k_9 = Number(fc0k_8)
e005_3 = Number(list_item_3)
betac_2 = Number(βc_glulam_7)
critical_load_purlin_2 = Panel(expression_151)

fc0d_10 = Number(fc0d_8)
fc0k_10 = Number(fc0k_8)
betac_3 = Number(βc_glulam_7)
python_14 = GhPythonScript(
    P=P,
    cc=cc,
    fc0d=fc0d_10,
    fc0k=fc0k_10,
    E005=e005,
    betac=betac_3,
    NdP=addition_18,
    qEdp=expression_128,
    fmk=fmk_4,
    fmd=fmd_2,
    fvd=fvd,
    kcr=kcr,
    ft0d=ft0d)  # -> flatten(out), eP1, eP2, eP3, eP4; inputs P: list
# ---------- python_14: Python ----------
__author__ = "ext-verena.gerl"
__version__ = "2024.03.12"

import rhinoscriptsyntax as rs
import math

for x in P:
    bP = x
    hP = 2*bP
    AP = bP*hP
    Iz = hP*bP**3/12
    i = (Iz/AP)**(0.5)
    lam = (cc*10**3)/i
    lambdarel = lam/math.pi*(fc0k/E005)**(0.5)
    kz = 0.5*(1+betac*(lambdarel-0.3)+(lambdarel)**2)
    kcz = 1/(kz+(kz**2-lambdarel**2)**0.5) 
    sigmac = NdP/(hP*bP)
    sigmam = (qEdp*(cc*10**3)**2/8)/(bP*hP**2/6)
    sigmamcrit = (0.78*(bP)**2)/(hP*cc*10**3)*E005
    lambdarelm = (fmk/sigmamcrit)**0.5
    a = 1.56 - (0.75*lambdarelm)
    b = 1 / (lambdarelm*lambdarelm)
    if lambdarelm < 0.75 or lambdarelm == 0.75:
        kcrit = 1
    if 0.75 < lambdarelm < 1.4:
        kcrit = a
    if 1.4 < lambdarelm:
        kcrit = b
    eP1 = sigmac / fc0d
    eP2 = NdP / (((math.pi**(2)*E005*(bP*hP**3/12))/(cc*10**3)**2))
    eP3 = sigmam / (kcrit*fmd)
    eP4 = ((qEdp*cc/2)/(kcr*bP*hP*fvd*10**(-3)/1.5))
    
    eta = ((sigmam/(kcrit*fmd))**2)+(sigmac/(kcz*fc0d))
    
    if eta < 1 or eta == 1:
        print x 
        break 
    else:
        continue
# ---------- end python_14 ----------
multiplication_62 = Multiplication(A=python_14.out, B=2)
bp_mm = Panel(python_14.out)
hp_mm = Panel(multiplication_62)
eta_1_3 = Panel([python_14.eP1, python_14.eP2, python_14.eP3, python_14.eP4])

hp_mm_2 = Panel(multiplication_62)
bp_mm_2 = Panel(python_14.out)

expression_153 = Expression(hP=hp_mm_2, bP=bp_mm_2, L=hall_lenght_l_m, nP=number_of_purlins_np, Expression="10^-6*hP*bP*L*nP")
ma = MassAddition(Input=[multiplication_37, expression_153, expression_144])  # -> Result, PartialResults
vmax_m3 = Panel(ma.Result)

# ----
# Fire Calculations
expression_154 = Expression(qh=expression_152, ec=actual_ec, Expression="qh*2*ec")

addition_24 = Addition(Qh=expression_154)  # -> flatten(Result)
expression_155 = Expression(np=np_for_bracing, P=addition_24, Expression="(np-1)*P/2")
design_load_into_each_strut_kn_2 = Panel(addition_24)
force_actting_on_struts_at_support_rd_kn_2 = Panel(expression_155)
python_15 = GhPythonScript(CSB=csb_2, cc=cc_3, fc0d=fc0d_9, fc0k=fc0k_9, E005=e005_3, betac=betac_2, Rd=expression_155)  # -> flatten(out), a; inputs CSB: list; same code as python_10
multiplication_63 = Multiplication(A=python_15.out, B=1)
bcs_fi_mm = Panel(python_15.out)
hcs_fi_mm = Panel(multiplication_63)
division_71 = Division(BCSfi=bcs_fi_mm, BSC=bcs_mm_2)
ηcs_fi = Panel(division_71)

merge_10 = Merge(Data1=eta_1_3, Data2=ηcs_fi)
inc_5 = Includes(Value=merge_10, Domain=panel_31)  # -> Includes, Deviation
panel_94 = Panel(merge_10)
panel_95 = Panel(inc_5.Includes)
partition_15 = PartitionList(List=panel_95, Size=1)  # -> simplify(Chunks)
partition_16 = PartitionList(List=panel_94, Size=1)  # -> simplify(Chunks)
merge_11 = Merge(Data1=partition_3, Data2=partition_15, Data3=partition_16)
panel_96 = Panel(partition_15)
panel_97 = Panel(merge_11)

utilization_list_combined = Panel([panel_91, panel_95, panel_86, panel_75, panel_56])
results_purlins_utilization_ratios = Panel(panel_97)

python_16 = GhPythonScript(utilization_list=flatten(utilization_list_combined), Volume=vmax_m3)  # -> flatten(out), a; inputs utilization_list: list
# ---------- python_16: Python ----------
__author__ = "ext-verena.gerl"
__version__ = "2024.02.13"


if any (x == 'False' for x in utilization_list):
    A='<null>'
    a=False
else:
    A=Volume
    a=True
print A
# ---------- end python_16 ----------
volume = Number(python_16.out)
optimization_input = Panel(volume)
bool = Boolean(python_16.a)

python_17 = GhPythonScript(v=volume)  # -> simplify(volume), a
# ---------- python_17: Python ----------
__author__ = "ext-elisabet.gunnars"
__version__ = "2024.03.20"

import rhinoscriptsyntax as rs

if v >0:
    A= v
else:
    A=0
print A
# ---------- end python_17 ----------
flatten_5 = FlattenTree(Tree=python_17.volume, Path="{0}")
division_72 = Division(A=flatten_5, B=multiplication_17)

merge_12 = Merge(
    Data1=frame_span_s_jon_m,
    Data2=height_h_m,
    Data3=hall_lenght_l_m,
    Data4=hb_mm,
    Data5=bb_mm,
    Data6=angle_apex_degree,
    Data7=column_cs_ratio_rc,
    Data8=nf_2,
    Data9=actual_ec,
    Data10=actual_mb_mm,
    Data11=column_width_bc_bb_mm,
    Data12=hc_bc_x_mm,
    Data13=distance_between_frames_cc_m,
    Data14=number_of_purlins_np,
    Data15=bp_mm_2,
    Data16=hp_mm_2,
    Data17=bcs_mm_2,
    Data18=hcs_mm_2,
    Data19=python_12.drout,
    Data20=python_12.dwout,
    Data21=flatten_5,
    Data22=division_72)
rec = DataRecorder(merge_12, DataLimit=-10, RecordData=False)
partition_17 = PartitionList(List=[parameter_names, rec], Size=22)  # -> simplify(Chunks)
panel_98 = Panel(partition_17)
xl_out = WriteToExcelClassic(WorkbookFilepath=path, Data=panel_98, LocationAddress="A1", Clear=0, Stream=Toggle(False))

hp = Number(hp_mm_2)
bp = Number(bp_mm_2)
division_73 = Division(HP=hp, B=panel_93)
division_74 = Division(BP=bp, B=panel_93)
division_75 = Division(A=division_74, B=-2)
X_6 = UnitX(Factor=division_75)

division_76 = Division(HP=bp, _1000=2000)
X_7 = UnitX(Factor=division_76)
X_8 = UnitX(Factor=division_76)
neg_11 = Negative(Value=X_7)

move_9 = Move(Geometry=divide_2.Points, Motion=neg_11)  # -> Geometry, Transform
cull_i_2 = CullIndex(List=reverse(simplify(move_9.Geometry)), Indices=0, Wrap=True)  # -> reverse(List)
flip = FlipMatrix(Data=cull_i_2)
item_67 = ListItem(List=flip, Index=simplify(range), Wrap=True)
rev_3 = ReverseList(List=item_67)
cull_i_3 = CullIndex(List=rev_3, Indices=0, Wrap=True)
cull_i_4 = CullIndex(List=item_67, Indices=0, Wrap=True)
rev_4 = ReverseList(List=cull_i_3)
ln_4 = Line(StartPoint=rev_4, EndPoint=cull_i_4)

move_10 = Move(Geometry=cull_i, Motion=X_8)  # -> Geometry, Transform
merge_13 = Merge(Data1=move_10.Geometry, Data2=item_54)
flip_2 = FlipMatrix(Data=merge_13)
item_68 = ListItem(List=flip_2, Index=simplify(range), Wrap=True)
rev_5 = ReverseList(List=item_68)
cull_i_5 = CullIndex(List=rev_5, Indices=0, Wrap=True)
cull_i_6 = CullIndex(List=item_68, Indices=0, Wrap=True)
rev_6 = ReverseList(List=cull_i_5)
ln_5 = Line(StartPoint=rev_6, EndPoint=cull_i_6)

item_69 = ListItem(List=reverse(flip), Index=0, Wrap=True)  # -> flatten(Item)
item_70 = ListItem(List=reverse(flip_2), Index=0, Wrap=True)  # -> flatten(Item)
item_71 = ListItem(List=reverse(flip_2), Index=1, Wrap=True)  # -> flatten(Item)
item_72 = ListItem(List=reverse(flip), Index=1, Wrap=True)  # -> flatten(Item)
merge_14 = Merge(Data1=item_70, Data2=reverse(item_69))
merge_15 = Merge(Data1=item_71, Data2=reverse(item_72))
cull = CullPattern(List=merge_14, CullPattern=panel_40)
cull_2 = CullPattern(List=merge_15, CullPattern=panel_40)
cull_i_7 = CullIndex(List=reverse(cull), Indices=0, Wrap=True)  # -> reverse(List)
cull_i_8 = CullIndex(List=reverse(cull_2), Indices=0, Wrap=True)  # -> reverse(List)
cull_i_9 = CullIndex(List=cull_2, Indices=0, Wrap=True)
cull_i_10 = CullIndex(List=cull, Indices=0, Wrap=True)
ln_6 = Line(StartPoint=cull_i_10, EndPoint=cull_i_8)
ln_7 = Line(StartPoint=cull, EndPoint=cull_2)
ln_8 = Line(StartPoint=cull_i_7, EndPoint=cull_i_9)
xz = XZPlane(Origin=cull)
rectangle_3 = Rectangle(Plane=xz, XSize=division_62, YSize=division_63, Radius=0)  # -> Rectangle, Length
vec2pt = Vector2Pt(PointA=cull_i_10, PointB=cull_i_8, Unitize=False)  # -> Vector, Length
vec2pt_2 = Vector2Pt(PointA=cull_i_7, PointB=cull_i_9, Unitize=False)  # -> Vector, Length
X_9 = UnitX(Factor=division_76)
circle = CircleCNR(Center=cull, Normal=vec2pt_2.Vector, Radius=division_64)
move_11 = Move(Geometry=rectangle_3.Rectangle, Motion=X_4)  # -> Geometry, Transform
circle_2 = CircleCNR(Center=cull, Normal=vec2pt.Vector, Radius=division_64)
move_12 = Move(Geometry=move_11.Geometry, Motion=X_9)  # -> Geometry, Transform
cull_i_11 = CullIndex(List=circle_2, Indices=0, Wrap=True)
cull_i_12 = CullIndex(List=reverse(circle), Indices=0, Wrap=True)  # -> reverse(List)
move_13 = Move(Geometry=move_12.Geometry, Motion=Z_4)  # -> Geometry, Transform
extrcrv_3 = ExtrudeAlong(Base=move_13.Geometry, Curve=ln_7)
extrcrv_4 = ExtrudeAlong(Base=cull_i_12, Curve=ln_8)  # -> flatten(Extrusion)
extrcrv_5 = ExtrudeAlong(Base=cull_i_11, Curve=ln_6)  # -> flatten(Extrusion)
move_14 = Move(Geometry=[extrcrv_3, extrcrv_4, extrcrv_5], Motion=neg_3)  # -> Geometry, Transform

item_73 = ListItem(List=flip, Index=0, Wrap=True)  # -> flatten(Item)
item_74 = ListItem(List=flip_2, Index=0, Wrap=True)  # -> flatten(Item)
item_75 = ListItem(List=flip_2, Index=1, Wrap=True)  # -> flatten(Item)
item_76 = ListItem(List=flip, Index=1, Wrap=True)  # -> flatten(Item)
merge_16 = Merge(Data1=item_74, Data2=reverse(item_73))
merge_17 = Merge(Data1=item_75, Data2=reverse(item_76))
cull_3 = CullPattern(List=merge_16, CullPattern=panel_41)
cull_4 = CullPattern(List=merge_17, CullPattern=panel_41)
cull_i_13 = CullIndex(List=reverse(cull_3), Indices=0, Wrap=True)  # -> reverse(List)
cull_i_14 = CullIndex(List=reverse(cull_4), Indices=0, Wrap=True)  # -> reverse(List)
cull_i_15 = CullIndex(List=cull_4, Indices=0, Wrap=True)
cull_i_16 = CullIndex(List=cull_3, Indices=0, Wrap=True)
ln_9 = Line(StartPoint=cull_i_16, EndPoint=cull_i_14)
ln_10 = Line(StartPoint=cull_3, EndPoint=cull_4)
ln_11 = Line(StartPoint=cull_i_13, EndPoint=cull_i_15)
xz_2 = XZPlane(Origin=cull_3)
rectangle_4 = Rectangle(Plane=xz_2, XSize=division_65, YSize=division_66, Radius=0)  # -> Rectangle, Length
vec2pt_3 = Vector2Pt(PointA=cull_i_16, PointB=cull_i_14, Unitize=False)  # -> Vector, Length
vec2pt_4 = Vector2Pt(PointA=cull_i_13, PointB=cull_i_15, Unitize=False)  # -> Vector, Length
X_10 = UnitX(Factor=division_76)
circle_3 = CircleCNR(Center=cull_3, Normal=vec2pt_4.Vector, Radius=division_67)
move_15 = Move(Geometry=rectangle_4.Rectangle, Motion=X_5)  # -> Geometry, Transform
circle_4 = CircleCNR(Center=cull_3, Normal=vec2pt_3.Vector, Radius=division_67)
move_16 = Move(Geometry=move_15.Geometry, Motion=X_10)  # -> Geometry, Transform
cull_i_17 = CullIndex(List=circle_4, Indices=0, Wrap=True)
cull_i_18 = CullIndex(List=reverse(circle_3), Indices=0, Wrap=True)  # -> reverse(List)
move_17 = Move(Geometry=move_16.Geometry, Motion=Z_6)  # -> Geometry, Transform
extrcrv_6 = ExtrudeAlong(Base=move_17.Geometry, Curve=ln_10)
extrcrv_7 = ExtrudeAlong(Base=cull_i_18, Curve=ln_11)  # -> flatten(Extrusion)
extrcrv_8 = ExtrudeAlong(Base=cull_i_17, Curve=ln_9)  # -> flatten(Extrusion)
move_18 = Move(Geometry=[extrcrv_6, extrcrv_7, extrcrv_8], Motion=neg_6)  # -> Geometry, Transform

item_77 = ListItem(List=reverse(cull_3), Index=0, Wrap=True)
item_78 = ListItem(List=reverse(cull_4), Index=0, Wrap=True)
item_79 = ListItem(List=cull_4, Index=0, Wrap=True)
item_80 = ListItem(List=cull_3, Index=0, Wrap=True)
move_19 = Move(Geometry=[item_77, item_78, item_80, item_79], Motion=neg_9)  # -> Geometry, Transform
item_81 = ListItem(List=move_19.Geometry, Index=[1, 3], Wrap=True)
item_82 = ListItem(List=move_19.Geometry, Index=[0, 2], Wrap=True)
ln_12 = Line(StartPoint=move_19.Geometry, EndPoint=[item_57, item_58, item_60, item_59])
vec2pt_5 = Vector2Pt(PointA=item_82, PointB=[item_57, item_60], Unitize=False)  # -> Vector, Length
vec2pt_6 = Vector2Pt(PointA=item_81, PointB=[item_58, item_59], Unitize=False)  # -> Vector, Length
circle_5 = CircleCNR(Center=item_82, Normal=vec2pt_5.Vector, Radius=division_68)
circle_6 = CircleCNR(Center=item_81, Normal=vec2pt_6.Vector, Radius=division_68)
item_83 = ListItem(List=ln_12, Index=[0, 2], Wrap=True)
item_84 = ListItem(List=ln_12, Index=[1, 3], Wrap=True)
extrcrv_9 = ExtrudeAlong(Base=circle_5, Curve=item_83)  # -> flatten(Extrusion)
extrcrv_10 = ExtrudeAlong(Base=circle_6, Curve=item_84)  # -> flatten(Extrusion)

item_85 = ListItem(List=reverse(cull), Index=0, Wrap=True)
item_86 = ListItem(List=reverse(cull_2), Index=0, Wrap=True)
item_87 = ListItem(List=cull_2, Index=0, Wrap=True)
item_88 = ListItem(List=cull, Index=0, Wrap=True)
move_20 = Move(Geometry=[item_85, item_86, item_88, item_87], Motion=neg_10)  # -> Geometry, Transform
item_89 = ListItem(List=move_20.Geometry, Index=[1, 3], Wrap=True)
item_90 = ListItem(List=move_20.Geometry, Index=[0, 2], Wrap=True)
ln_13 = Line(StartPoint=move_20.Geometry, EndPoint=[item_64, item_63, item_66, item_65])
vec2pt_7 = Vector2Pt(PointA=item_90, PointB=[item_64, item_66], Unitize=False)  # -> Vector, Length
vec2pt_8 = Vector2Pt(PointA=item_89, PointB=[item_63, item_65], Unitize=False)  # -> Vector, Length
circle_7 = CircleCNR(Center=item_90, Normal=vec2pt_7.Vector, Radius=division_69)
circle_8 = CircleCNR(Center=item_89, Normal=vec2pt_8.Vector, Radius=division_69)
item_91 = ListItem(List=ln_13, Index=[0, 2], Wrap=True)
item_92 = ListItem(List=ln_13, Index=[1, 3], Wrap=True)
extrcrv_11 = ExtrudeAlong(Base=circle_7, Curve=item_91)  # -> flatten(Extrusion)
extrcrv_12 = ExtrudeAlong(Base=circle_8, Curve=item_92)  # -> flatten(Extrusion)

xz_3 = XZPlane(Origin=[cull_i_5, cull_i_3])
rectangle_5 = Rectangle(Plane=xz_3, XSize=division_74, YSize=division_73, Radius=0)  # -> Rectangle, Length
move_21 = Move(Geometry=rectangle_5.Rectangle, Motion=X_6)  # -> Geometry, Transform
extrcrv_13 = ExtrudeAlong(Base=move_21.Geometry, Curve=ln_5)

# ----
# Visualization
visualization_structure = Geometry([frame_visualization.Geometry, extrcrv_13, move_14.Geometry, extrcrv_11, extrcrv_12, move_18.Geometry, extrcrv_9, extrcrv_10])

# ==== cluster STEELRODSYSTEMDETANEAndS

# ----
# DETAN-S
ft_rd_kn = Panel("""81.22
126.9
182.7
238.1
290.6
423.4
581.1
763.7
911.3
1052.4
1224.5
1387.2
2016.2
2564.9
3252.0""")
ft_rd_kn_2 = Panel("""9.05
16.47
26.10
37.92
70.50
110.2
158.6
206.7
252.3
367.5
504.4
662.9
791.0
913.5
1062.9
1204.2
1750.2
2226.5
2822.9""")
ft_rd_kn_3 = Panel("""78.96
123.4
177.7
231.5
282.5
411.6
564.9
742.5
885.9
1023.1
1190.5
1348.7
1960.2
2493.7
3161.6""")
ft_rd_kn_4 = Panel("""7.39
13.44
21.3
30.94""")
mxx_d_in_mm = Panel("""16
20
24
27
30
36
42
48
52
56
60
64
76
85
95""")
mxx_d_in_mm_2 = Panel("""6
8
10
12
16
20
24
27
30
36
42
48
52
56
60
64
76
85
95""")
mxx_d_in_mm_3 = Panel("""16
20
24
27
30
36
42
48
52
56
60
64
76
85
95""")
mxx_d_in_mm_4 = Panel("""6
8
10
12""")
halfen_system_size = Panel("""M16 (S520)
M20 (S520)
M24 (S520)
M27 (S520)
M30 (S520)
M36 (S520)
M42 (S520)
M48 (S520)
M52 (S520)
M56 (S520)
M60 (S520)
M64 (S520)
M76 (S520)
M85 (S520)
M95 (S520)""")
halfen_system_size_2 = Panel("""M6 (S355)
M8 (S355)
M10 (S355)
M12 (S355)""")
halfen_system_size_3 = Panel("""M6 (S460)
M8 (S460)
M10 (S460)
M12 (S460)
M16 (S460)
M20 (S460)
M24 (S460)
M27 (S460)
M30 (S460)
M36 (S460)
M42 (S460)
M48 (S460)
M52 (S460)
M56 (S460)
M60 (S460)
M64 (S460)
M76 (S460)
M85 (S460)
M95 (S460)""")
halfen_system_size_4 = Panel("""M16 (S470)
M20 (S470)
M24 (S470)
M27 (S470)
M30 (S470)
M36 (S470)
M42 (S470)
M48 (S470)
M52 (S470)
M56 (S470)
M60 (S470)
M64 (S470)
M76 (S470)
M85 (S470)
M95 (S470)""")

# ----
# DETAN-E
ft_rd_kn_5 = Panel("""8.69
9.42
15.81
17.13
24.99
27.14
35.99
39.44
63.97
73.32
99.96
114.6
143.9
165.0
182.2
215.0
224.9
262.4
323.9
382.2
440.8
524.6
575.8
689.4""")
mxx_d_in_mm_5 = Panel("""6
6
8
8
10
10
12
12
16
16
20
20
24
24
27
27
30
30
36
36
42
42
48
48""")
halfen_system_size_5 = Panel("""M6 (S355)
M6 (S460)
M8 (S355)
M8 (S460)
M10 (S355)
M10 (S460)
M12 (S355)
M12 (S460)
M16 (S355)
M16 (S460)
M20 (S355)
M20 (S460)
M24 (S355)
M24 (S460)
M27 (S355)
M27 (S460)
M30 (S355)
M30 (S460)
M36 (S355)
M36 (S460)
M42 (S355)
M42 (S460)
M48 (S355)
M48 (S469)""")

ft_rd_kn_6 = ClusterOutput(ft_rd_kn)
ft_rd_kn_7 = ClusterOutput(ft_rd_kn_2)
ft_rd_kn_8 = ClusterOutput(ft_rd_kn_3)
ft_rd_kn_9 = ClusterOutput(ft_rd_kn_4)
mxx_d_in_mm_6 = ClusterOutput(mxx_d_in_mm)
mxx_d_in_mm_7 = ClusterOutput(mxx_d_in_mm_2)
mxx_d_in_mm_8 = ClusterOutput(mxx_d_in_mm_3)
mxx_d_in_mm_9 = ClusterOutput(mxx_d_in_mm_4)
halfen_system_size_6 = ClusterOutput(halfen_system_size)
halfen_system_size_7 = ClusterOutput(halfen_system_size_2)
halfen_system_size_8 = ClusterOutput(halfen_system_size_3)
halfen_system_size_9 = ClusterOutput(halfen_system_size_4)
